vi "Function_2.gvi"   [LabVIEW NXG 5.0.0]
panel controls:
  "stop": bool
panel indicators:
  "Shift": i32
  "No Shift": i32
diagram:
  s1 = 0  # shift register
  while {
    Increment(x=0) -> w1
    $"No Shift" <- w1
    Increment(x=s1) -> w2
    $Shift <- w2
    next s1 = w2
    stop if $stop
  }
