vi "Dividing Wavelength Calculator.gvi"   [LabVIEW NXG 5.0.0]
inputs:
  "Error In": error
  "Full MSpot Multispectral Data Array In": "Full MSpot Multispectral Data.gtype"[]
  "Dividing Wavelength Threshold": f64
  "cutoff frequency": f64 = 0.125
outputs:
  "Error Out": error
  "Full MSpot Multispectral Data Array Out": "Full MSpot Multispectral Data.gtype"[]
types:
  "MSpot Spectrum Data.gtype" = cluster{"M Spot Spectrum": cluster{"Wavelength": f64[], "Counts": f64[]}, "Blue Motor Position (mm)": f64, "Red Motor Position (mm)": f64, "Dividing Wavelength (nm)": f64}
  "Rainbow Sweep Types.gtype" = enum{"Red Sweep Closing", "Red Sweep Opening", "Blue Sweep Closing", "Blue Sweep Opening"}
  "Full MSpot Multispectral Data.gtype" = cluster{"MSpot Spectrum Data Array": "MSpot Spectrum Data.gtype"[], "Rainbow Sweep Types": "Rainbow Sweep Types.gtype"}
uses:
  NI::Analysis::IntegralDifferentiation::Derivative x(t).gvi
  NI::Analysis::Filtering::Butterworth Lowpass Filter (DBL).gvi
diagram:
  case ($"Error In") {
    frame Error, Default {
      w1 = $"Error In"
      w2 = $"Full MSpot Multispectral Data Array In"
    }
    frame No Error {
      for {
        w3 = each element of $"Full MSpot Multispectral Data Array In"
        Property Node(instance in=w3) -> ("MSpot Spectrum Data Array"=w4, instance out=w5)
        for {
          w6 = each element of w4
          Property Node(instance in=w6) -> ("M Spot Spectrum"=w8, instance out=w9)
          Property Node(instance in=w8) -> ("Wavelength"=w10, "Counts"=w11)
          call "Derivative x(t).gvi"(x(t)=w11) -> (dx(t)/dt=w12)
          Absolute Value(x=w12) -> w13
          call "Butterworth Lowpass Filter (DBL).gvi"(signal=w13, cutoff frequency=$"cutoff frequency") -> (filtered signal=w14)
          for (iteration -> i1) {
            w15 = each element of w14
            w16 = each element of w10
            Is Greater(x=w15, y=$"Dividing Wavelength Threshold") -> w18
            Is Greater(x=i1, y=30) -> w19
            Logical And(w18, w19) -> w20
            w17 = w16 if w20
            stop if w20
          }
          Property Node(instance in=w9, "Dividing Wavelength (nm)"=w17) -> (instance out=w21)
          append w21 to w7
        }
        Property Node(instance in=w5, "MSpot Spectrum Data Array"=w7) -> (instance out=w22)
        append w22 to w2
      }
      w1 = $"Error In"
    }
  }
  $"Error Out" <- w1
  $"Full MSpot Multispectral Data Array Out" <- w2
