vi "MSpot Calibration Save Graphs Prompt.gvi"   [LabVIEW NXG 5.0.0]
inputs:
  "Calibration Operatino Control": "Calibration Operation Control.gtype" = "Check Calibration"
  "Error In": error
outputs:
  "Selected State": "MSpot Spectrum Calibration State Machine Instructions.gtype"
  "Error Out": error
types:
  "Calibration Operation Control.gtype" = enum{"Check Calibration", "Load Calibration", "New Calibration"}
  "MSpot Spectrum Calibration State Machine Instructions.gtype" = enum{"Start App", "Detect Instruments", "Initialize Instruments", "Rainbow Sweep", "Close Coms", "Load Calibration", "Check Graphs", "Save Graphs", "Stop App"}
diagram:
  # This subVI Prompts the user to save or discard the calibration files in case
  # the operation was new calibration. Otherwise it does not
  case ($"Error In") {
    frame Error, Default {
      w1 = "Stop App"
      w2 = $"Error In"
    }
    frame No Error {
      case ($"Calibration Operatino Control") {
        frame "Load Calibration", Default {
          w1 = "Stop App"
        }
        frame "Check Calibration" {
          w1 = "Stop App"
        }
        frame "New Calibration" {
          w3 = "Do you wish to save the current\ncalibration files?\nThey will be saved on the Extra \ninstallers folder."
          Two Button Dialog(F button name ("Cancel")="Oh, don't bother\nI was just testing.", T button name ("OK")="Yes please save \nthe calibration files :D", message=w3) -> (T Button?=w4)
          Select(s=w4, t="Save Graphs", f="Stop App") -> w1
        }
      }
      w2 = $"Error In"
    }
  }
  $"Selected State" <- w1
  $"Error Out" <- w2
