vi "MSpot Spectra file handling.gvi"   [LabVIEW NXG 5.0.0]
inputs:
  "Error In": error
  "Full MSpot Multispectral Data Array In": "Full MSpot Multispectral Data.gtype"[]
  "Modify File Operation": "Modify File Operation.gtype" = "Save TXT"
outputs:
  "Error Out": error
  "Full MSpot Multispectral Data Array Out": "Full MSpot Multispectral Data.gtype"[]
  "Found Any File?": bool
types:
  "MSpot Spectrum Data.gtype" = cluster{"M Spot Spectrum": cluster{"Wavelength": f64[], "Counts": f64[]}, "Blue Motor Position (mm)": f64, "Red Motor Position (mm)": f64, "Dividing Wavelength (nm)": f64}
  "Rainbow Sweep Types.gtype" = enum{"Red Sweep Closing", "Red Sweep Opening", "Blue Sweep Closing", "Blue Sweep Opening"}
  "Full MSpot Multispectral Data.gtype" = cluster{"MSpot Spectrum Data Array": "MSpot Spectrum Data.gtype"[], "Rainbow Sweep Types": "Rainbow Sweep Types.gtype"}
  "Modify File Operation.gtype" = enum{"Save TXT", "Load TXT"}
uses:
  Rainbow Measurement Setup::Main Functions::One Time Calibrations::MSpot Spectrum::Dividing Wavelength Calculations::Spectra Operator.gvi
  Rainbow Measurement Setup::Main Functions::One Time Calibrations::MSpot Spectrum::File Handling::MSpot Folder Scan.gvi
  Rainbow Measurement Setup::Main Functions::One Time Calibrations::MSpot Spectrum::File Handling::Folder Scan Sweep type.gvi
  Rainbow Measurement Setup::Main Functions::One Time Calibrations::MSpot Spectrum::File Handling::File number Sorter.gvi
  Rainbow Measurement Setup::Main Functions::One Time Calibrations::MSpot Spectrum::File Handling::MSpot Data Extractor.gvi
  Rainbow Measurement Setup::Main Functions::One Time Calibrations::MSpot Spectrum::File Handling::MSpot Folder Check.gvi
  Rainbow Measurement Setup::Side Functions::Sample Naming::txt Extension adder.gvi
  Rainbow Measurement Setup::Main Functions::Modify TXT file::Modify Measurement TXT File.gvi
diagram:
  # This subVI Handles the Saving of all the MSpot Spectra Calibration Files
  case ($"Error In") {
    frame Error, Default {
      w1 = $"Error In"
      w2 = $"Full MSpot Multispectral Data Array In"
      w3 = default
    }
    frame No Error {
      disable {
        frame Disabled {
          w4 = $"Full MSpot Multispectral Data Array In"
          w5 = $"Error In"
        }
        frame Enabled {
          s1 = $"Error In"  # shift register
          for {
            w6 = each element of $"Full MSpot Multispectral Data Array In"
            call "Spectra Operator.gvi"(Full MSpot Multispectral Data=w6, Error In=s1) -> (Operated Data=w7, Error Out=w8)
            append w7 to w4
            next s1 = w8
          }
          w5 = s1
        }
      }
      case ($"Modify File Operation") {
        frame "Load TXT" {
          call "MSpot Folder Scan.gvi"(Error In=w5) -> (Folder Path=w9, Folder Names=w10, Error Out=w11)
          s2 = w11  # shift register
          s3 = "Full MSpot Multispectral Data.gtype"[] []  # shift register
          s4 = 0  # shift register
          for {
            w12 = each element of w10
            call "Folder Scan Sweep type.gvi"(Folder Name In=w12, Error In=s2) -> (Foldername Out=w14, Sweep Type=w15, Is folder sweep type?=w16, Error Out=w17)
            case (w16) {
              frame False, Default {
                w18 = s4
                w19 = s3
                w20 = w17
                w21 = default
              }
              frame True {
                Increment(x=s4) -> w18
                Array Index(array=s3) -> (out0[s4]=w22)
                Build Path(base path=w9, name or relative path=w14) -> (appended path=w23)
                List Folder(error in=w17, path=w23) -> (error out=w24, file names=w25, path out=w26)
                call "File number Sorter.gvi"(Sweep Type=w15, File Names=w25, Error In=w24) -> (Sorted Files Array=w27, Error Out=w28)
                s5 = w28  # shift register
                s6 = "MSpot Spectrum Data.gtype"[] []  # shift register
                s7 = 0  # shift register
                for {
                  w29 = each element of w27
                  Build Path(base path=w26, name or relative path=w29) -> (appended path=w31)
                  Search And Replace String(input string=w29, search string="MSpot_Spectrum_Calibration") -> (number of replacements=w32)
                  Is Not Equal To 0(x=w32) -> w33
                  call "MSpot Data Extractor.gvi"(Filepath to load=w31, Sub Array Index In=s7, M Spot Spectrum Sub Array In=s6, Modify file operation=$"Modify File Operation", Calibration file?=w33, Error In=s5) -> (Sub Array Index Out=w34, M Spot Spectrum Sub Array Out=w35, File Found?=w36, Error Out=w37)
                  append w36 to w30
                  next s5 = w37
                  next s6 = w35
                  next s7 = w34
                }
                Property Node(instance in=w22, "MSpot Spectrum Data Array"=s6, "Rainbow Sweep Types"=w15) -> (instance out=w38)
                Insert Into Array(inArray=s3, new=w38) -> w19
                Or Array Elements(Boolean array=w30) -> (logical OR=w21)
                w20 = s5
              }
            }
            append w21 to w13
            next s2 = w20
            next s3 = w19
            next s4 = w18
          }
          Or Array Elements(Boolean array=w13) -> (logical OR=w3)
          w1 = s2
          w2 = s3
        }
        frame "Save TXT", Default {
          s8 = w5  # shift register
          for {
            w39 = each element of w4
            Property Node(instance in=w39) -> ("MSpot Spectrum Data Array"=w40, "Rainbow Sweep Types"=w41)
            disable {
              frame Disabled { }
              frame Enabled {
                Reverse 1D Array(array=w40) -> (reversed array=w42)
              }
            }
            call "MSpot Folder Check.gvi"(Rainbow Sweep Types=w41, Error In=s8, Create New Folders?=TRUE) -> (Folder Out=w43, Error Out=w44)
            s9 = w44  # shift register
            for (iteration -> i1) {
              w45 = each element of w42
              Property Node(instance in=w45) -> ("M Spot Spectrum"=w46, "Blue Motor Position (mm)"=w47, "Red Motor Position (mm)"=w48)
              Format Into String(w47) -> w49
              Format Into String(w48) -> w50
              Concatenate Strings("Blue Motor Position (mm): ", w49, "\t", "Red Motor Position (mm): ", w50) -> w51
              disable {
                frame Enabled {
                  Number To Decimal String(number=i1, width (-)=3) -> (decimal integer string=w53)
                  Concatenate Strings(w53, "MSpot_Spectrum_Calibration_Position_") -> w52
                }
                frame Disabled {
                  w52 = "MSpot_Spectrum_Calibration_Position_"
                }
              }
              Format Into String(initString=w52, w47) -> w54
              Concatenate Strings(w54, "_") -> w55
              Format Into String(initString=w55, w48) -> w56
              call "txt Extension adder.gvi"(Name without .txt=w56, Error In=s9) -> (Name with .txt=w57, Error Out=w58)
              Property Node(instance in=w46) -> ("Wavelength"=w59, "Counts"=w60)
              Build Array(w59, w60) -> w61
              Transpose 2D Array(2D array=w61) -> (transposed array=w62)
              Build Path(base path=w43, name or relative path=w57) -> (appended path=w63)
              call "Modify Measurement TXT File.gvi"(Filename to load/save=w63, Variable Header Info=w51, Modify File Operation=$"Modify File Operation", Data To Save=w62, Error In=w58, Measurement File Type="Light Calibration Dividing Wavelength Spectrum") -> (Error Out=w64)
              next s9 = w64
            }
            next s8 = s9
          }
          w1 = s8
          w2 = w4
          w3 = default
        }
      }
    }
  }
  $"Full MSpot Multispectral Data Array Out" <- w2
  $"Found Any File?" <- w3
  $"Error Out" <- w1
