vi "MSpot Spectrum Calibration Subroutine.gvi"   [LabVIEW NXG 5.0.0]
inputs:
  "Error In": error
  "Stand Alone?": bool
  "Calibration Operation Control": "Calibration Operation Control.gtype" = "Check Calibration"
  "Instrument Coms Info In": "Instrument Coms Info.gtype"
  "Rainbow Sweep Param Selector": "Rainbow Sweep Param Selector.gtype" = {0, 1100, 300, 1, 1, 0}
  "Debugging Cluster In": "Debugging Cluster.gtype"
outputs:
  "Error Out": error
  "Instrument Coms Info Out": "Instrument Coms Info.gtype"
  "Debugging Cluster Out": "Debugging Cluster.gtype"
  "Full Beam Multispectral Data Array": "Full MSpot Multispectral Data.gtype"[]
panel controls:
  "MSpot Spectrum Calibration Parameters In": "MSpot Spectrum Calibration Parameters.gtype" = {"Min Position (mm)"=0, "Max Position (mm)"=10, "Position step size (mm)"=0.1, "Manual Spectra?"=FALSE, "Flame Integration Time (us)"=1000, "Flame Scans to Average"=1}
types:
  T1 = cluster{"Element 1": "VISA Instr", "Element 2": string}
  "Arduino Detection cluster control.gtype" = cluster{"XZ Stage Arduino Address": "VISA Instr", "XZ Stage Arduino Detected?": bool, "Multiplexer Arduino Detected?": bool, "Multiplexer Arduino Address": "VISA Instr", "Arduinos List": T1[], "XZ Stage Log": string, "Multiplexer Log": string}
  "Thorlabs Motors Serial Number In.gtype" = cluster{"Thorlabs Blue Motor": string, "Thorlabs Red Motor": string, "Blue Motor Homed?": bool, "Red Motor Homed?": bool}
  "Instrument Coms Info.gtype" = cluster{"Arduino Coms Info": "Arduino Detection cluster control.gtype", "Photodetector Names": string[], "Keythley Address": "VISA Instr", "Photodetector Detected?": bool, "Thorlabs Motors Detected?": bool, "Keithley Detected?": bool, "Thorlabs Motors Serial Number": "Thorlabs Motors Serial Number In.gtype", "Photodetector IVI session": "Ivi IviDefault", "Flame ID": string, "Flame Detected?": bool, "Flame Wrapper ID": u64}
  "Raibow Sweep Selector.gtype" = enum{"Red Sweep", "Blue Sweep", "Full Sweep Red First", "Full Sweep Blue First"}
  T2 = enum{"Red Sweep Closing", "Red Sweep Opening", "Red Sweep Both Ways"}
  T3 = enum{"Blue Sweep Opening", "Blue Sweep Closing", "Blue Sweep Both Ways"}
  "Rainbow Sweep Type Selector.gtype" = cluster{"Red Sweep Mode": T2, "Blue Sweep Mode": T3}
  "Rainbow Sweep Param Selector.gtype" = cluster{"Raibow Sweep Selector": "Raibow Sweep Selector.gtype", "Max Wavelength (nm)": f64, "Min Wavelength (nm)": f64, "Wavelength Step (nm)": f64, "Rainbow Sweep Type Selector": "Rainbow Sweep Type Selector.gtype"}
  "MSpot Spectrum Data.gtype" = cluster{"M Spot Spectrum": cluster{"Wavelength": f64[], "Counts": f64[]}, "Blue Motor Position (mm)": f64, "Red Motor Position (mm)": f64}
  "Rainbow Sweep Types.gtype" = enum{"Red Sweep Closing", "Red Sweep Opening", "Blue Sweep Closing", "Blue Sweep Opening"}
  "Full MSpot Multispectral Data.gtype" = cluster{"MSpot Spectrum Data Array": "MSpot Spectrum Data.gtype"[], "Rainbow Sweep Types": "Rainbow Sweep Types.gtype"}
  "Insturment Debugging Cluster.gtype" = cluster{"Keithley": bool, "Arduinos": bool, "Thorlabs Motors": bool, "Photodetector": bool, "Flame Spectr": bool}
  "Debugging Cluster.gtype" = cluster{"Debugging mode?": bool, "Initialize App": bool, "Insturment Debugging": "Insturment Debugging Cluster.gtype"}
  "Calibration Operation Control.gtype" = enum{"Check Calibration", "Load Calibration", "New Calibration"}
  "MSpot Spectrum Calibration Parameters.gtype" = cluster{"Min Position (mm)": f64, "Max Position (mm)": f64, "Position step size (mm)": f64, "Manual Spectra?": bool, "Flame Integration Time (us)": f64, "Flame Scans to Average": u32}
uses:
  Rainbow Measurement Setup::Main Functions::Instruction Queue::Current State::FGV Current State.gvi
  Rainbow Measurement Setup::Side Functions::Global Abort::FGV Global Abort.gvi
  Rainbow Measurement Setup::Side Functions::Instrument Control::Debug Cluster Instrument Extractor.gvi
  Rainbow Measurement Setup::Main Functions::One Time Calibrations::Beam Power Density::Specific Detect Instruments Subroutine.gvi
  Rainbow Measurement Setup::Side Functions::Instrument Control::Thorlabs Motors::Movement::KCube Move to 0 or Home.gvi
  Rainbow Measurement Setup::Side Functions::Instrument Control::Arduino::XZ Stage Arduino::XZ Stage Initialize And Home.gvi
  Rainbow Measurement Setup::Side Functions::Instrument Control::Photodetector::Photodetector Initialize.gvi
  Rainbow Measurement Setup::Side Functions::Instrument Control::Flame Spectrometer::Flame Initialize.gvi
  Rainbow Measurement Setup::Main Functions::One Time Calibrations::MSpot Spectrum::MSpot Spectrum Rainbow Sweep Subroutine.gvi
  Rainbow Measurement Setup::Side Functions::Instrument Control::Photodetector::Photodetector Close Coms.gvi
  Rainbow Measurement Setup::Side Functions::Instrument Control::Arduino::XZ Stage Arduino::XZ Stage Close Coms.gvi
  Rainbow Measurement Setup::Side Functions::Instrument Control::Flame Spectrometer::Flame Close.gvi
  Rainbow Measurement Setup::Main Functions::One Time Calibrations::MSpot Spectrum::File Handling::MSpot Spectra file handling.gvi
  Rainbow Measurement Setup::Main Functions::One Time Calibrations::MSpot Spectrum::File Handling::MSpot Load Prompt.gvi
  Rainbow Measurement Setup::Main Functions::One Time Calibrations::MSpot Spectrum::MSpot Spectrum Visualizer.gvi
  Rainbow Measurement Setup::Main Functions::One Time Calibrations::MSpot Spectrum::File Handling::MSpot Calibration Save Graphs Prompt.gvi
diagram:
  w1 = $"MSpot Spectrum Calibration Parameters In"
  # This subVI takes a full spectrum for each guillotine motor position and then changes the guillotine position and continues on taking spectra.
  # After all the spectra have been taken we are presented with the results to determine the dividing wavelength for each position and then we can
  # write down the dividing wavelength file.
  case ($"Error In") {
    frame Error, Default {
      w2 = $"Error In"
      w3 = default
      w4 = $"Instrument Coms Info In"
      w5 = $"Debugging Cluster In"
    }
    frame No Error {
      call "FGV Current State.gvi"(Current State Instructions="Set Current State and Substate", Current State="MSpot Spectrum Calibration", Current Substate="", Error In=$"Error In") -> (Error Out=w6)
      s1 = w6  # shift register
      s2 = "Start App"  # shift register
      s2.prev1 = uninitialised  # shift register
      s3 = $"Instrument Coms Info In"  # shift register
      s4 = uninitialised  # shift register
      s5 = $"Debugging Cluster In"  # shift register
      while {
        call "FGV Global Abort.gvi"(Global Abort Instructions="Read Current State") -> (Local Abort Out=w7, Global Abort Out=w8)
        Select(s=w7, t="Close Coms", f=s2) -> w9
        case (w9) {
          frame "Start App", Default {
            call "FGV Current State.gvi"(Current State Instructions="Set Current Substate", Current Substate="Starting MSpot Calibration", Error In=s1) -> (Error Out=w11)
            Select(s=$"Stand Alone?", t="Detect Instruments", f="Initialize Instruments") -> w16
            Is Equal(x="Check Calibration", y=$"Calibration Operation Control") -> w17
            Is Equal(x="Load Calibration", y=$"Calibration Operation Control") -> w18
            Logical Or(w17, w18) -> w19
            Select(s=w19, t="Load Calibration", f=w16) -> w10
            w12 = s3
            w13 = s4
            w14 = default
            w15 = s5
          }
          frame "Detect Instruments" {
            call "FGV Current State.gvi"(Current State Instructions="Set Current Substate", Current Substate="Detecting Instruments", Error In=s1) -> (Error Out=w20)
            call "Debug Cluster Instrument Extractor.gvi"(Debugging Cluster In=s5, Error In=w20) -> (Debuging Cluster Out=w15, Instruments to Detect=w21, Error Out=w22)
            call "Specific Detect Instruments Subroutine.gvi"(Instrument Coms Info In=s3, Error In=w22, Instruments To Detect Array=w21, Stand Alone?=$"Stand Alone?") -> (Instrument Coms Info Out=w12, Error Out=w11)
            w10 = "Initialize Instruments"
            w13 = s4
            w14 = default
          }
          frame "Initialize Instruments" {
            call "FGV Current State.gvi"(Current State Instructions="Set Current Substate", Current Substate="Initializing Instruments", Error In=s1) -> (Error Out=w23)
            call "KCube Move to 0 or Home.gvi"(Instrument Coms Info In=s3, Debugging Cluster In=s5, Error In=w23) -> (Instrument Coms Info Out=w24, Debugging Cluster Out=w25, Error Out=w26)
            call "XZ Stage Initialize And Home.gvi"(Instrument Coms Info In=w24, Debugging Cluster In=w25, Error In=w26) -> (Instrument Coms Info Out=w27, Debugging Cluster Out=w28, Error Out=w29)
            call "Photodetector Initialize.gvi"(Instrument Coms Info In=w27, Debugging Cluster In=w28, Error In=w29) -> (Instrument Coms Info Out=w30, Debugging Cluster Out=w31, Error Out=w32)
            call "Flame Initialize.gvi"(Instrument Coms Info In=w30, Debugging Cluster In=w31, Error In=w32) -> (Instrument Coms Info Out=w12, Debugging Cluster Out=w15, Error Out=w11)
            w10 = "Rainbow Sweep"
            w13 = s4
            w14 = default
          }
          frame "Rainbow Sweep" {
            $"Full Beam Multispectral Data Array" <- "Full MSpot Multispectral Data.gtype"[] []
            call "FGV Current State.gvi"(Current State Instructions="Set Current Substate", Current Substate="Acquiring Spectra", Error In=s1) -> (Error Out=w33)
            call "MSpot Spectrum Rainbow Sweep Subroutine.gvi"(Instrument Coms Info In=s3, MSpot Spectrum Calibration Parameters In=w1, Rainbow Sweep Param Selector=$"Rainbow Sweep Param Selector", Debugging Cluster In=s5, Error In=w33) -> (Instrument Coms Info Out=w12, Full MSpot Multispectral Data Array=w13, Debugging Cluster Out=w15, Error Out=w11)
            w10 = "Close Coms"
            w14 = default
          }
          frame "Close Coms" {
            call "FGV Current State.gvi"(Current State Instructions="Set Current Substate", Current Substate="Closing Coms", Error In=s1) -> (Error Out=w34)
            call "Photodetector Close Coms.gvi"(Instrument Coms Info In=s3, Debugging Cluster In=s5, Error In=w34) -> (Instrument Coms Info Out=w35, Debugging Cluster Out=w36, Error Out=w37)
            call "XZ Stage Close Coms.gvi"(Instrument Coms Info In=w35, Error In=w37) -> (Instrument Coms Info Out=w38, Error Out=w39)
            call "Flame Close.gvi"(Instrument Coms Info In=w38, Debugging Cluster In=w36, Error In=w39) -> (Instrument Coms Info Out=w12, Debugging Cluster Out=w15, Error Out=w11)
            Select(s=w7, t="Stop App", f="Check Graphs") -> w10
            w13 = s4
            w14 = default
          }
          frame "Load Calibration" {
            call "FGV Current State.gvi"(Current State Instructions="Set Current Substate", Current Substate="Loading Calibration", Error In=s1) -> (Error Out=w40)
            call "MSpot Spectra file handling.gvi"(Full MSpot Multispectral Data Array In=s4, Modify File Operation="Load TXT", Error In=w40) -> (Full MSpot Multispectral Data Array Out=w13, Found Any File?=w41, Error Out=w42)
            call "MSpot Load Prompt.gvi"(Found Any File?=w41, Stand Alone=$"Stand Alone?", Error In=w42) -> (Desired State=w10, Error Out=w11)
            w12 = s3
            w14 = default
            w15 = s5
          }
          frame "Check Graphs" {
            call "FGV Current State.gvi"(Current State Instructions="Set Current Substate", Current Substate="Checking Graphs", Error In=s1) -> (Error Out=w43)
            call "MSpot Spectrum Visualizer.gvi"(Full MSpot Multispectral Data Array=s4, Error In=w43) -> (Error Out=w44)
            call "MSpot Calibration Save Graphs Prompt.gvi"(M Spot Spectrum Calibration State Machine Instructions=s2.prev1, Error In=w44) -> (Selected State=w10, Error Out=w11)
            w12 = s3
            w13 = s4
            w14 = default
            w15 = s5
          }
          frame "Save Graphs" {
            call "FGV Current State.gvi"(Current State Instructions="Set Current Substate", Current Substate="Saving Graphs", Error In=s1) -> (Error Out=w45)
            call "MSpot Spectra file handling.gvi"(Full MSpot Multispectral Data Array In=s4, Modify File Operation="Save TXT", Error In=w45) -> (Full MSpot Multispectral Data Array Out=w13, Error Out=w11)
            w10 = "Stop App"
            w12 = s3
            w14 = default
            w15 = s5
          }
          frame "Stop App" {
            call "FGV Current State.gvi"(Current State Instructions="Set Current Substate", Current Substate="Finishing MSpot Calibration", Error In=s1) -> (Error Out=w11)
            w10 = "Start App"
            w12 = s3
            w13 = s4
            w14 = TRUE
            w15 = s5
          }
        }
        Logical Or(w8, w14) -> w46
        next s1 = w11
        next s2 = w10
        next s3 = w12
        next s4 = w13
        next s5 = w15
        stop if w46
      }
      w2 = s1
      w3 = s4
      w4 = s3
      w5 = s5
    }
  }
  $"Debugging Cluster Out" <- w5
  $"Error Out" <- w2
  $"Full Beam Multispectral Data Array" <- w3
  $"Instrument Coms Info Out" <- w4
