vi "MSpot Spectrum Rainbow Sweep Subroutine.gvi"   [LabVIEW NXG 5.0.0]
inputs:
  "Instrument Coms Info In": "Instrument Coms Info.gtype"
  "MSpot Spectrum Calibration Parameters": "MSpot Spectrum Calibration Parameters.gtype" = {"Min Position (mm)"=0, "Max Position (mm)"=10, "Position step size (mm)"=0.1, "Manual Spectra?"=FALSE}
  "Rainbow Sweep Param Selector": "Rainbow Sweep Param Selector.gtype" = {0, 1100, 300, 1, 1, 0}
  "Error In": error
  "Debugging Cluster In": "Debugging Cluster.gtype"
outputs:
  "Instrument Coms Info Out": "Instrument Coms Info.gtype"
  "Full MSpot Multispectral Data Array": "Full MSpot Multispectral Data.gtype"[]
  "Debugging Cluster Out": "Debugging Cluster.gtype"
  "Error Out": error
types:
  "Raibow Sweep Selector.gtype" = enum{"Red Sweep", "Blue Sweep", "Full Sweep Red First", "Full Sweep Blue First"}
  "Rainbow Sweep Type Selector.gtype" = cluster{"Red Sweep Mode": enum{"Red Sweep Closing", "Red Sweep Opening"}, "Blue Sweep Mode": enum{"Blue Sweep Opening", "Blue Sweep Closing"}}
  "Rainbow Sweep Param Selector.gtype" = cluster{"Raibow Sweep Selector": "Raibow Sweep Selector.gtype", "Max Wavelength (nm)": f64, "Min Wavelength (nm)": f64, "Wavelength Step (nm)": f64, "Rainbow Sweep Types": "Rainbow Sweep Type Selector.gtype"}
  "MSpot Spectrum Data.gtype" = cluster{"M Spot Spectrum": cluster{"Wavelength": f64[], "Counts": f64[]}, "Blue Motor Position (mm)": f64, "Red Motor Position (mm)": f64}
  "Rainbow Sweep Types.gtype" = enum{"Red Sweep Closing", "Red Sweep Opening", "Blue Sweep Closing", "Blue Sweep Opening"}
  "Full MSpot Multispectral Data.gtype" = cluster{"MSpot Spectrum Data Array": "MSpot Spectrum Data.gtype"[], "Rainbow Sweep Types": "Rainbow Sweep Types.gtype"}
  T1 = cluster{"Element 1": "VISA Instr", "Element 2": string}
  "Arduino Detection cluster control.gtype" = cluster{"XZ Stage Arduino Address": "VISA Instr", "XZ Stage Arduino Detected?": bool, "Multiplexer Arduino Detected?": bool, "Multiplexer Arduino Address": "VISA Instr", "Arduinos List": T1[], "XZ Stage Log": string, "Multiplexer Log": string}
  "Thorlabs Motors Serial Number In.gtype" = cluster{"Thorlabs Blue Motor": string, "Thorlabs Red Motor": string, "Blue Motor Homed?": bool, "Red Motor Homed?": bool}
  "Instrument Coms Info.gtype" = cluster{"Arduino Coms Info": "Arduino Detection cluster control.gtype", "Photodetector Names": string[], "Keythley Address": "VISA Instr", "Photodetector Detected?": bool, "Thorlabs Motors Detected?": bool, "Keithley Detected?": bool, "Thorlabs Motors Serial Number": "Thorlabs Motors Serial Number In.gtype", "Photodetector IVI session": "Ivi IviDefault"}
  "Insturment Debugging Cluster.gtype" = cluster{"Keithley": bool, "Arduinos": bool, "Thorlabs Motors": bool, "Photodetector": bool}
  "Debugging Cluster.gtype" = cluster{"Debugging mode?": bool, "Initialize App": bool, "Insturment Debugging": "Insturment Debugging Cluster.gtype"}
  "MSpot Spectrum Calibration Parameters.gtype" = cluster{"Min Position (mm)": f64, "Max Position (mm)": f64, "Position step size (mm)": f64, "Manual Spectra?": bool}
uses:
  Rainbow Measurement Setup::Main Functions::One Time Calibrations::MSpot Spectrum::MSpot Step Calculator.gvi
  Rainbow Measurement Setup::Side Functions::Rainbow Sweep::Rainbow Sweep Type Extractor.gvi
  Rainbow Measurement Setup::Side Functions::Instrument Control::Thorlabs Motors::Movement::KCube Initialize and Home.gvi
  Rainbow Measurement Setup::Main Functions::One Time Calibrations::MSpot Spectrum::Random Data Generator.gvi
  Rainbow Measurement Setup::Side Functions::Instrument Control::Thorlabs Motors::Movement::KCube Motor Single Move to Position.gvi
  Rainbow Measurement Setup::Side Functions::Instrument Control::Thorlabs Motors::Movement::KCube Motors Close.gvi
diagram:
  # This SubVI Performs a scan of the spectrum of the beam (STILL FLAME CONNECTION MISSING) and then moves the blade motors to perform a full scan of the spectrum with respect to position.
  case ($"Error In") {
    frame Error, Default {
      w1 = default
      w2 = $"Error In"
      w3 = $"Instrument Coms Info In"
      w4 = $"Debugging Cluster In"
    }
    frame No Error {
      call "MSpot Step Calculator.gvi"(MSpot Spectrum Calibration Parameters In=$"MSpot Spectrum Calibration Parameters") -> (Manual Spectra?=w5, Number of steps=w6)
      call "Rainbow Sweep Type Extractor.gvi"(Rainbow Sweep Parameters=$"Rainbow Sweep Param Selector", Error In=$"Error In") -> (Rainbow Sweep Array=w7, Error Out=w8)
      s1 = "Full MSpot Multispectral Data.gtype"[] []  # shift register
      s2 = w8  # shift register
      s3 = $"Instrument Coms Info In"  # shift register
      s4 = $"Debugging Cluster In"  # shift register
      for (iteration -> i1) {
        w9 = each element of w7
        Array Index(array=s1) -> (out0[i1]=w10)
        case (w9) {
          frame "Red Sweep Opening", Default {
            call "KCube Initialize and Home.gvi"(Instrument Coms Info In=s3, Debugging Cluster In=s4, Error In=s2, KCube Motor Selector="Blue Motor") -> (Instrument Coms Info Out=w15, Debugging Cluster Out=w16, Error Out=w17)
            s5 = w17  # shift register
            s6 = "MSpot Spectrum Data.gtype"[] []  # shift register
            s7 = w15  # shift register
            s8 = w16  # shift register
            for (N = w6) (iteration -> i2) {
              case (w5) {
                frame False, Default { }
                frame True {
                  Wait Until Next Multiple(multiple to wait=300)
                  w18 = "Please Save the spectrum file\non the oceanview software\nbefore continuing."
                  One Button Dialog(button name ("OK")="Okay, I will", message=w18)
                }
              }
              Property Node(instance in=$"MSpot Spectrum Calibration Parameters") -> ("Max Position (mm)"=w19, "Position step size (mm)"=w20)
              To Double Precision Float(number=i2) -> w21
              Multiply(w20, w21) -> w22
              Subtract(x=w19, y=w22) -> w23
              call "Random Data Generator.gvi"() -> (Beam Spectrum=w24)
              Property Node(instance in="MSpot Spectrum Data.gtype" {all zero or empty}, "M Spot Spectrum"=w24, "Blue Motor Position (mm)"=w23, "Red Motor Position (mm)"=0) -> (instance out=w25)
              Insert Into Array(inArray=s6, index0=i2, new=w25) -> w26
              call "KCube Motor Single Move to Position.gvi"(Instrument Coms Info In=s7, Debugging Cluster In=s8, Motor Position to move to (mm)=w23, Error In=s5, KCube Motor Selector="Blue Motor") -> (Instrument Coms Info Out=w27, Debugging Cluster Out=w28, Error Out=w29)
              next s5 = w29
              next s6 = w26
              next s7 = w27
              next s8 = w28
            }
            Property Node(instance in=w10, "Rainbow Sweep Types"=w9, "MSpot Spectrum Data Array"=s6) -> (instance out=w13)
            call "KCube Motors Close.gvi"(Instrument Coms Info In=s7, Error In=s5) -> (Instrument Coms Info Out=w11, Error Out=w12)
            w14 = s8
          }
          frame "Red Sweep Closing" {
            call "KCube Initialize and Home.gvi"(Instrument Coms Info In=s3, Debugging Cluster In=s4, Error In=s2, KCube Motor Selector="Blue Motor") -> (Instrument Coms Info Out=w30, Debugging Cluster Out=w31, Error Out=w32)
            s9 = w32  # shift register
            s10 = "MSpot Spectrum Data.gtype"[] []  # shift register
            s11 = w30  # shift register
            s12 = w31  # shift register
            for (N = w6) (iteration -> i3) {
              case (w5) {
                frame False, Default { }
                frame True {
                  Wait Until Next Multiple(multiple to wait=300)
                  w33 = "Please Save the spectrum file\non the oceanview software\nbefore continuing."
                  One Button Dialog(button name ("OK")="Okay, I will", message=w33)
                }
              }
              Property Node(instance in=$"MSpot Spectrum Calibration Parameters") -> ("Min Position (mm)"=w34, "Position step size (mm)"=w35)
              To Double Precision Float(number=i3) -> w36
              Multiply(w35, w36) -> w37
              Add(w34, w37) -> w38
              call "Random Data Generator.gvi"() -> (Beam Spectrum=w39)
              Property Node(instance in="MSpot Spectrum Data.gtype" {all zero or empty}, "M Spot Spectrum"=w39, "Blue Motor Position (mm)"=w38, "Red Motor Position (mm)"=0) -> (instance out=w40)
              Insert Into Array(inArray=s10, index0=i3, new=w40) -> w41
              call "KCube Motor Single Move to Position.gvi"(Instrument Coms Info In=s11, Debugging Cluster In=s12, Motor Position to move to (mm)=w38, Error In=s9, KCube Motor Selector="Blue Motor") -> (Instrument Coms Info Out=w42, Debugging Cluster Out=w43, Error Out=w44)
              next s9 = w44
              next s10 = w41
              next s11 = w42
              next s12 = w43
            }
            Property Node(instance in=w10, "Rainbow Sweep Types"=w9, "MSpot Spectrum Data Array"=s10) -> (instance out=w13)
            call "KCube Motors Close.gvi"(Instrument Coms Info In=s11, Error In=s9) -> (Instrument Coms Info Out=w11, Error Out=w12)
            w14 = s12
          }
          frame "Blue Sweep Closing" {
            call "KCube Initialize and Home.gvi"(Instrument Coms Info In=s3, Debugging Cluster In=s4, Error In=s2, KCube Motor Selector="Red Motor") -> (Instrument Coms Info Out=w45, Debugging Cluster Out=w46, Error Out=w47)
            s13 = w47  # shift register
            s14 = "MSpot Spectrum Data.gtype"[] []  # shift register
            s15 = w46  # shift register
            s16 = w45  # shift register
            for (N = w6) (iteration -> i4) {
              case (w5) {
                frame False, Default { }
                frame True {
                  Wait Until Next Multiple(multiple to wait=300)
                  w48 = "Please Save the spectrum file\non the oceanview software\nbefore continuing."
                  One Button Dialog(button name ("OK")="Okay, I will", message=w48)
                }
              }
              Property Node(instance in=$"MSpot Spectrum Calibration Parameters") -> ("Min Position (mm)"=w49, "Position step size (mm)"=w50)
              To Double Precision Float(number=i4) -> w51
              Multiply(w50, w51) -> w52
              Add(w49, w52) -> w53
              call "Random Data Generator.gvi"() -> (Beam Spectrum=w54)
              Property Node(instance in="MSpot Spectrum Data.gtype" {all zero or empty}, "M Spot Spectrum"=w54, "Red Motor Position (mm)"=w53, "Blue Motor Position (mm)"=0) -> (instance out=w55)
              Insert Into Array(inArray=s14, index0=i4, new=w55) -> w56
              call "KCube Motor Single Move to Position.gvi"(Instrument Coms Info In=s16, Debugging Cluster In=s15, Motor Position to move to (mm)=w53, Error In=s13, KCube Motor Selector="Red Motor") -> (Instrument Coms Info Out=w57, Debugging Cluster Out=w58, Error Out=w59)
              next s13 = w59
              next s14 = w56
              next s15 = w58
              next s16 = w57
            }
            Property Node(instance in=w10, "Rainbow Sweep Types"=w9, "MSpot Spectrum Data Array"=s14) -> (instance out=w13)
            call "KCube Motors Close.gvi"(Instrument Coms Info In=s16, Error In=s13) -> (Instrument Coms Info Out=w11, Error Out=w12)
            w14 = s15
          }
          frame "Blue Sweep Opening" {
            call "KCube Initialize and Home.gvi"(Instrument Coms Info In=s3, Debugging Cluster In=s4, Error In=s2, KCube Motor Selector="Red Motor") -> (Instrument Coms Info Out=w60, Debugging Cluster Out=w61, Error Out=w62)
            s17 = w62  # shift register
            s18 = "MSpot Spectrum Data.gtype"[] []  # shift register
            s19 = w61  # shift register
            s20 = w60  # shift register
            for (N = w6) (iteration -> i5) {
              case (w5) {
                frame False, Default { }
                frame True {
                  Wait Until Next Multiple(multiple to wait=300)
                  w63 = "Please Save the spectrum file\non the oceanview software\nbefore continuing."
                  One Button Dialog(button name ("OK")="Okay, I will", message=w63)
                }
              }
              Property Node(instance in=$"MSpot Spectrum Calibration Parameters") -> ("Position step size (mm)"=w64, "Max Position (mm)"=w65)
              To Double Precision Float(number=i5) -> w66
              Multiply(w64, w66) -> w67
              Subtract(x=w65, y=w67) -> w68
              call "Random Data Generator.gvi"() -> (Beam Spectrum=w69)
              Property Node(instance in="MSpot Spectrum Data.gtype" {all zero or empty}, "M Spot Spectrum"=w69, "Red Motor Position (mm)"=w68, "Blue Motor Position (mm)"=0) -> (instance out=w70)
              Insert Into Array(inArray=s18, index0=i5, new=w70) -> w71
              call "KCube Motor Single Move to Position.gvi"(Instrument Coms Info In=s20, Debugging Cluster In=s19, Motor Position to move to (mm)=w68, Error In=s17, KCube Motor Selector="Red Motor") -> (Instrument Coms Info Out=w72, Debugging Cluster Out=w73, Error Out=w74)
              next s17 = w74
              next s18 = w71
              next s19 = w73
              next s20 = w72
            }
            Property Node(instance in=w10, "Rainbow Sweep Types"=w9, "MSpot Spectrum Data Array"=s18) -> (instance out=w13)
            call "KCube Motors Close.gvi"(Instrument Coms Info In=s20, Error In=s17) -> (Instrument Coms Info Out=w11, Error Out=w12)
            w14 = s19
          }
        }
        Insert Into Array(inArray=s1, index0=i1, new=w13) -> w75
        next s1 = w75
        next s2 = w12
        next s3 = w11
        next s4 = w14
      }
      w1 = s1
      w2 = s2
      w3 = s3
      w4 = s4
    }
  }
  $"Instrument Coms Info Out" <- w3
  $"Debugging Cluster Out" <- w4
  $"Full MSpot Multispectral Data Array" <- w1
  $"Error Out" <- w2
