vi "MSpot Spectrum Visualizer.gvi"   [LabVIEW NXG 5.0.0]
inputs:
  "Error In": error
  "Full MSpot Multispectral Data Array": "Full MSpot Multispectral Data.gtype"[]
outputs:
  "Error Out": error
panel controls:
  "Sweep Type Selector": i32
  "Graph (position) Selector": i32
  "Continue": bool
  "Div Wavelength Threshold": f64
  "Divide?": bool
  "Erase Peaks?": bool
panel indicators:
  "Rainbow Sweep Type": "Rainbow Sweep Types.gtype"
  "M Spot Spectrum": cluster{"Element 1": f64[], "Element 2": f64[]}
  "MSpot Spectrum Data": "MSpot Spectrum Data.gtype"
types:
  "Rainbow Sweep Types.gtype" = enum{"Red Sweep Closing", "Red Sweep Opening", "Blue Sweep Closing", "Blue Sweep Opening"}
  "MSpot Spectrum Data.gtype" = cluster{"M Spot Spectrum": cluster{"Wavelength": f64[], "Counts": f64[]}, "Blue Motor Position (mm)": f64, "Red Motor Position (mm)": f64, "Dividing Wavelength (nm)": f64}
  "Full MSpot Multispectral Data.gtype" = cluster{"MSpot Spectrum Data Array": "MSpot Spectrum Data.gtype"[], "Rainbow Sweep Types": "Rainbow Sweep Types.gtype"}
uses:
  Rainbow Measurement Setup::Main Functions::One Time Calibrations::MSpot Spectrum::Dividing Wavelength Calculations::Dividing Wavelength Calculator.gvi
  Rainbow Measurement Setup::Main Functions::One Time Calibrations::MSpot Spectrum::Dividing Wavelength Calculations::Spectra Operator.gvi
diagram:
  Property Node(instance in=reference to unnamed native front panel, error in=$"Error In") -> ("Window"=w1, error out=w2)
  Open Window(reference in=w1, error in=w2) -> (reference out=w3, error out=w4)
  # This subVI allows us to visualize the data obtained on the Measuring Spot Spectrum Calibration subroutine so that we can
  # extract our own conclusions and elaborate the calibration file.
  case (w4) {
    frame Error, Default {
      w5 = w4
      w6 = w3
    }
    frame No Error {
      Is Empty Array(array=$"Full MSpot Multispectral Data Array") -> w7
      case (w7) {
        frame True {
          One Button Dialog(button name ("OK")="Oh, sorry", message="No Calibration Found")
          w5 = w4
        }
        frame False {
          while {
            call "Dividing Wavelength Calculator.gvi"(Full MSpot Multispectral Data Array In=$"Full MSpot Multispectral Data Array", Error In=w4, Dividing Wavelength Threshold=$"Div Wavelength Threshold") -> (Full MSpot Multispectral Data Array Out=w8, Error Out=w9)
            Array Size(array=w8) -> (size(s)=w10)
            Decrement(x=w10) -> w11
            Array Index(array=w8) -> (out0[$"Sweep Type Selector"]=w12)
            case ($"Divide?") {
              frame False, Default {
                w13 = w12
                w14 = w9
              }
              frame True {
                call "Spectra Operator.gvi"(Full MSpot Multispectral Data=w12, Error In=w9, Spectra Operator control="Divide Spectra") -> (Operated Data=w13, Error Out=w14)
              }
            }
            case ($"Erase Peaks?") {
              frame False, Default {
                w15 = w13
                w16 = w14
              }
              frame True {
                call "Spectra Operator.gvi"(Full MSpot Multispectral Data=w13, Error In=w14, Spectra Operator control="Erase Peaks") -> (Operated Data=w15, Error Out=w16)
              }
            }
            Is Equal To 0(x=w11) -> w17
            Not(x=w17) -> w18
            Property Node(instance in=reference to "Sweep Type Selector", "Maximum"=w11, "Minimum"=0, "Visible"=w18, error in=w16) -> (error out=w19)
            Property Node(instance in=w15) -> ("MSpot Spectrum Data Array"=w20, "Rainbow Sweep Types"=w21)
            Array Size(array=w20) -> (size(s)=w22)
            Decrement(x=w22) -> w23
            Property Node(instance in=reference to "Graph (position) Selector", "Minimum"=0, "Maximum"=w23, error in=w19) -> (error out=w5)
            Array Index(array=w20) -> (out0[$"Graph (position) Selector"]=w24)
            Property Node(instance in=w24) -> ("M Spot Spectrum"=w25, "Dividing Wavelength (nm)"=w26)
            Property Node(instance in=w25) -> ("Wavelength"=w27, "Counts"=w28)
            Is Empty Array(array=w28) -> w29
            case (w29) {
              frame True { }
              frame False {
                Build Cluster(w27, w28) -> w30
                $"M Spot Spectrum" <- w30
              }
            }
            $"MSpot Spectrum Data" <- w24
            Property Node(instance in=reference to "M Spot Spectrum") -> ("Cursor"=w31)
            Property Node(instance in=w31, "XPosition"=w26, "Visible"=TRUE)
            Wait Until Next Multiple(multiple to wait=50)
            $"Rainbow Sweep Type" <- w21
            stop if $Continue
          }
        }
      }
      w6 = w3
    }
  }
  Close Window(reference in=w6, error in=w5) -> (error out=w32)
  $"Error Out" <- w32
