vi "FF and Efficiency.gvi"   [LabVIEW NXG 5.0.0]
inputs:
  "Error In": error
  "IV Sweep Data In": "IV Refined Single Sweep Data.gtype"
  "IV Single Measurement": "IV Single Measurement.gtype"
outputs:
  "Error Out": error
  "IV Sweep Data Out": "IV Refined Single Sweep Data.gtype"
types:
  "IV Refined Single Sweep Data.gtype" = cluster{"Rs (Ω/m^2)": f64, "Rsh (Ω/m^2)": f64, "Jsc (A/m^2)": f64, "Voc (V)": f64, "FF (%)": f64, "Efficiency (%)": f64, "Dividing Wavelength": f64, "Light Power": f64}
  "IV Single Measurement.gtype" = cluster{"Voltage": f64[], "Current": f64[], "Current Density": f64[], "Dividing Wavelength": f64, "Light Power": f64}
diagram:
  # This SubVI Calculates the point of maximum generated power
  # and calculates the filling factor taking into account the previously
  # calculated Jsc and Voc.
  case ($"Error In") {
    frame Error, Default {
      w1 = $"Error In"
      w2 = $"IV Sweep Data In"
    }
    frame No Error {
      Property Node(instance in=$"IV Sweep Data In") -> ("Voc (V)"=w3, "Jsc (A/m^2)"=w4, "Light Power"=w5, instance out=w6)
      Multiply(w3, w4) -> w7
      Absolute Value(x=w7) -> w8
      Property Node(instance in=$"IV Single Measurement") -> ("Voltage"=w9, "Current Density"=w10, "Current"=w11)
      Multiply(w9, w10) -> w12
      Array Max And Min(array=w12) -> (min value=w13)
      Absolute Value(x=w13) -> w14
      Multiply(w14, 100) -> w15
      Divide(x=w15, y=w8) -> w16
      Multiply(w9, w11) -> w17
      Array Max And Min(array=w17) -> (min value=w18)
      Absolute Value(x=w18) -> w19
      Divide(x=w19, y=w5) -> w20
      Multiply(w20, 100) -> w21
      Property Node(instance in=w6, "FF (%)"=w16, "Efficiency (%)"=w21) -> (instance out=w2)
      w1 = $"Error In"
    }
  }
  $"Error Out" <- w1
  $"IV Sweep Data Out" <- w2
