vi "SRM Check Light Power Data.gvi"   [LabVIEW NXG 5.0.0]
inputs:
  "Error In": error
  "SRM Mega Cluster In": "SRM Mega Cluster.gtype"
  "Misc Data Mega Cluster In": "Misc Data Mega Cluster.gtype"
  "LPC Mega Cluster In": "LPC Mega Cluster.gtype"
  "Input State": "SRM States.gtype" = "Detect Instruments"
outputs:
  "Error Out": error
  "Next State": "SRM States.gtype"
  "SRM Mega Cluster Out": "SRM Mega Cluster.gtype"
  "LPC Mega Cluster Out": "LPC Mega Cluster.gtype"
types:
  "SRM States.gtype" = enum{"Start App", "Load Light Power Calibration", "Detect Instruments", "Initialize Instruments", "Rainbow Sweep", "Close Coms", "Process IV Data", "Load Measurement", "Save Graphs", "Enqueue Light Calibration", "Stop App"}
  "Full Reference Cluster.gtype" = cluster{"Enum Reference Cluster": "Enum Control Reference Cluster.gtype", "Boolean Reference Cluster": "Boolean Control Reference Cluster.gtype", "Numeric Reference Cluster": "Numeric Control Reference Cluster.gtype", "Numeric Cluster Reference Cluster": "Numeric Cluster Reference Cluster.gtype", "Path Reference Cluster": "Path Reference Cluster.gtype", "Cluster Reference Cluster": "Cluster Reference Cluster.gtype", "XZ Stage Controls Reference Cluster": "XZ Stage Controls Reference Cluster.gtype"}
  "Cell Naming Cluster.gtype" = cluster{"Cell Label": string, "Sample Prefix": string, "Author Initials": string, "Current Date": string, "Batch Name": string}
  T1 = cluster{"X Coordinate (mm)": f64, "Z Coordinate (mm)": f64}
  T2 = cluster{"X Coordinate (mm)": f64, "Z Coordinate (mm)": f64, "Vertical Spacing (mm)": f64}
  "XZ All Position Cluster.gtype" = cluster{"Diffusor Coordinates": T1, "Photodetector Coordinates": T1, "Cell R.01 Coordinates": T2}
  T3 = cluster{"Thorlabs Motor Serial Number File Path": path, "Default Data Saving Location": path}
  "Misc Data Mega Cluster.gtype" = cluster{"Full Reference Cluster": "Full Reference Cluster.gtype", "Cell Naming Cluster": "Cell Naming Cluster.gtype", "All XZ Position Cluster": "XZ All Position Cluster.gtype", "All Paths": T3}
  "Raibow Sweep Selector.gtype" = enum{"Red Sweep", "Blue Sweep", "Full Sweep Red First", "Full Sweep Blue First"}
  "Rainbow Sweep Param Selector.gtype" = cluster{"Raibow Sweep Selector": "Raibow Sweep Selector.gtype", "Max Wavelength (nm)": f64, "Min Wavelength (nm)": f64, "Wavelength Step (nm)": f64, "Rainbow Sweep Type Selector": "Rainbow Sweep Type Selector.gtype"}
  "Light power Calibration Parameters.gtype" = cluster{"Powermeter Averages": f64}
  T4 = cluster{"Dividing Wavelength Array": f64[], "Measured Power Array": f64[]}
  "Rainbow Sweep Types.gtype" = enum{"Red Sweep Closing", "Red Sweep Opening", "Blue Sweep Closing", "Blue Sweep Opening"}
  "Light Power Calibration Data.gtype" = cluster{"Single Light Calibration": T4, "Rainbow Sweep Types": "Rainbow Sweep Types.gtype", "Total Light Power": f64}
  "LPC Mega Cluster.gtype" = cluster{"Rainbow Sweep Parameters LPC": "Rainbow Sweep Param Selector.gtype", "LPC Specific Parameters": "Light power Calibration Parameters.gtype", "Light Power Calibration Data": "Light Power Calibration Data.gtype"[]}
  "SRM Specific Parameters.gtype" = cluster{"Max (V)": f64, "Min (V)": f64, "V Points": u32, "Current Range (A)": f64, "Autorange": bool, "Sweep Dir": bool, "Current Averages": u32, "Max (A)": f64, "Integration Time": f64, "Cell Area (m^2)": f64, "Full Spctr Ref": bool}
  "IV Full Data Cluster.gtype" = cluster{"IV Measurements Array": "IV Single Measurement.gtype"[], "Rainbow Sweep Types": "Rainbow Sweep Types.gtype", "IV Refined Data": "IV Refined Full Sweep Data.gtype"}
  "IV Full Raw Data.gtype" = cluster{"Rainbow Sweep Types": "Rainbow Sweep Types.gtype", "IV Raw Data Array": "IV Single Measurement.gtype"[]}
  "SRM Mega Cluster.gtype" = cluster{"SRM Specific Parameters": "SRM Specific Parameters.gtype", "Rainbow Sweep Parameters SRM": "Rainbow Sweep Param Selector.gtype", "SRM Full IV data Array": "IV Full Data Cluster.gtype"[], "Full IV Curve Raw Data": "IV Full Raw Data.gtype"[]}
uses:
  Rainbow Measurement Setup::Main Functions::Rainbow Measurement::Cell Single Rainbow Measurement::LPC Check::Light Power calibration data check subroutine.gvi
  Rainbow Measurement Setup::Main Functions::Rainbow Measurement::Cell Single Rainbow Measurement::LPC Check::SRM Light Power Check Operation Translator.gvi
  Rainbow Measurement Setup::Main Functions::Rainbow Measurement::Light Power Calibration::Light Power Operation FGV.gvi
diagram:
  # This SubVI Checks that the loaded light power calibration data is compatible with the selected rainbow sweep type and
  # if not it prompts the user with some options on what to do next. It also checks that the loaded light power calibration
  # is compatible with the selected rainbow sweep parameters such as wavelength step and range.
  case ($"Error In") {
    frame Error, Default {
      w1 = $"Error In"
      w2 = "Stop App"
      w3 = $"SRM Mega Cluster In"
      w4 = $"LPC Mega Cluster In"
    }
    frame No Error {
      Property Node(instance in=$"LPC Mega Cluster In") -> ("Light Power Calibration Data"=w5, instance out=w6)
      Is Empty Array(array=w5) -> w7
      case (w7) {
        frame False, Default {
          call "Light Power calibration data check subroutine.gvi"(LPC Megacluster In=w6, SRM Megacluster In=$"SRM Mega Cluster In", Misc Data Mega Cluster In=$"Misc Data Mega Cluster In", Error In=$"Error In") -> (Operation Control=w9, LPC Mega Cluster Out=w4, SRM Mega Cluster Out=w3, Cancelled Measurement?=w10, Error Out=w8)
        }
        frame True {
          w11 = "I could not find any light power calibration data. Make sure that you have either performed a light power calibration or that you have loaded the needed files. "
          Three Button Dialog(Allow user to close window? (TRUE)=FALSE, Center Button Text ("No")="Load Light Power\nCalibration files.", Left Button Text ("Yes")="New Light Power\nCalibration Now", Right Button Text ("Cancel")="Cancel\nMeasurement", Window Title (" ")="Missing Light power Calibration files", message=w11) -> (Which Button?=w9)
          Property Node(instance in=$"SRM Mega Cluster In") -> ("Rainbow Sweep Parameters SRM"=w12, instance out=w3)
          case (w9) {
            frame "left button" {
              Property Node(instance in=w6, "Rainbow Sweep Parameters LPC"=w12) -> (instance out=w4)
              Property Node(instance in=$"Misc Data Mega Cluster In") -> ("Full Reference Cluster:Cluster Reference Cluster:Rainbow Sweep Parameters LPC"=w13)
              Property Node(instance in=w13, "Value"=w12, error in=$"Error In") -> (error out=w8)
            }
            frame "center button", Default {
              w4 = w6
              w8 = $"Error In"
            }
          }
          w10 = default
        }
      }
      call "SRM Light Power Check Operation Translator.gvi"(User Selected Operation=w9, Error In=w8, Input State=$"Input State") -> (Next State=w14, Light Power Operation Control=w15, Error Out=w16)
      call "Light Power Operation FGV.gvi"(FGV Instructions="Set State", Light Power Operation In=w15, Error In=w16) -> (Error Out=w1)
      Select(s=w10, t="Stop App", f=w14) -> w2
    }
  }
  $"SRM Mega Cluster Out" <- w3
  $"Error Out" <- w1
  $"Next State" <- w2
  $"LPC Mega Cluster Out" <- w4
