vi "Single Rainbow Measurement Subroutine.gvi"   [LabVIEW NXG 5.0.0]
inputs:
  "Error In": error
  "Instruction Queue In": Queue<"Queue Instructions Control.gtype">
  "Stand Alone?": bool
  "Debugging Cluster In": "Debugging Cluster.gtype"
  "Instrument Coms Info In": "Instrument Coms Info.gtype"
  "Default Data Saving Location": path
  "Cell Naming Cluster": "Cell Naming Cluster.gtype"
  "Rainbow Tab Reference": "TabControl reference"
  "Rainbow Sweep Param Selector": "Rainbow Sweep Param Selector.gtype" = {0, 1100, 300, 1, 1, 0}
  "SRM Specific Parameters": "SRM Specific Parameters.gtype"
  "Light Power Calibration Data": "Light Power Calibration Data.gtype"[]
outputs:
  "Error Out": error
  "Instuments Coms Info Out": "Instrument Coms Info.gtype"
  "Debugging Cluster Out": "Debugging Cluster.gtype"
  "Instruction Queue Out": Queue<"Queue Instructions Control.gtype">
  "FulL IV data Cluster": "IV Full Data Cluster.gtype"[]
  "SRM Rainbow Parameters": "Rainbow Sweep Param Selector.gtype"
panel controls:
  "SRM Operation Control": "SRM Operation Control.gtype" = "New Measurement"
  "XZ All Position Cluster": "XZ All Position Cluster.gtype" = {146, 32.6, 188, 30, 39, 70}
types:
  "Insturment Debugging Cluster.gtype" = cluster{"Keithley": bool, "Arduinos": bool, "Thorlabs Motors": bool, "Photodetector": bool, "Flame Spectr": bool}
  "Debugging Cluster.gtype" = cluster{"Debugging mode?": bool, "Initialize App": bool, "Insturment Debugging": "Insturment Debugging Cluster.gtype"}
  T1 = cluster{"Element 1": "VISA Instr", "Element 2": string}
  "Arduino Detection cluster control.gtype" = cluster{"XZ Stage Arduino Address": "VISA Instr", "XZ Stage Arduino Detected?": bool, "Multiplexer Arduino Detected?": bool, "Multiplexer Arduino Address": "VISA Instr", "Arduinos List": T1[], "XZ Stage Log": string, "Multiplexer Log": string}
  "Thorlabs Motors Serial Number In.gtype" = cluster{"Thorlabs Blue Motor": string, "Thorlabs Red Motor": string, "Blue Motor Homed?": bool, "Red Motor Homed?": bool}
  "Instrument Coms Info.gtype" = cluster{"Arduino Coms Info": "Arduino Detection cluster control.gtype", "Photodetector Names": string[], "Keythley Address": "VISA Instr", "Photodetector Detected?": bool, "Thorlabs Motors Detected?": bool, "Keithley Detected?": bool, "Thorlabs Motors Serial Number": "Thorlabs Motors Serial Number In.gtype", "Photodetector IVI session": "Ivi IviDefault", "Flame ID": string, "Flame Detected?": bool, "Flame Wrapper ID": u64}
  "Cell Naming Cluster.gtype" = cluster{"Cell Label": string, "Sample Prefix": string, "Author Initials": string, "Current Date": string, "Batch Name": string}
  "Raibow Sweep Selector.gtype" = enum{"Red Sweep", "Blue Sweep", "Full Sweep Red First", "Full Sweep Blue First"}
  T2 = enum{"Red Sweep Closing", "Red Sweep Opening", "Red Sweep Both Ways"}
  T3 = enum{"Blue Sweep Opening", "Blue Sweep Closing", "Blue Sweep Both Ways"}
  "Rainbow Sweep Type Selector.gtype" = cluster{"Red Sweep Mode": T2, "Blue Sweep Mode": T3}
  "Rainbow Sweep Param Selector.gtype" = cluster{"Raibow Sweep Selector": "Raibow Sweep Selector.gtype", "Max Wavelength (nm)": f64, "Min Wavelength (nm)": f64, "Wavelength Step (nm)": f64, "Rainbow Sweep Type Selector": "Rainbow Sweep Type Selector.gtype"}
  "Queue Instructions Control.gtype" = enum{"Undefined State", "Debug Check", "Initialize App", "Idle", "Light Power Calibration", "Rainbow Single Measurement", "Light Calibration Irradiance", "Light Calibration Spectral Density", "Light Calibration Power Density", "MSpot Spectrum Calibration", "Move XZ Stage", "Access TXT File", "Stop App"}
  T4 = cluster{"Dividing Wavelength Array": f64[], "Measured Power Array": f64[]}
  "Rainbow Sweep Types.gtype" = enum{"Red Sweep Closing", "Red Sweep Opening", "Blue Sweep Closing", "Blue Sweep Opening"}
  "Light Power Calibration Data.gtype" = cluster{"Single Light Calibration": T4, "Rainbow Sweep Types": "Rainbow Sweep Types.gtype"}
  "IV Single Measurement.gtype" = cluster{"Voltage": f64[], "Current": f64[], "Current Density": f64[], "Dividing Wavelength": f64, "Light Power": f64}
  "IV Refined Full Sweep Data.gtype" = cluster{"Rs (Ω/m^2)": f64[], "Rsh (Ω/m^2)": f64[], "Jsc (A/m^2)": f64[], "Voc (V)": f64[], "FF (%)": f64[], "Efficiency (%)": f64[], "Dividing Wavelength (nm)": f64[], "Light Power (W)": f64[]}
  "IV Full Data Cluster.gtype" = cluster{"IV Measurements Array": "IV Single Measurement.gtype"[], "Rainbow Sweep Types": "Rainbow Sweep Types.gtype", "IV Refined Data": "IV Refined Full Sweep Data.gtype"}
  "SRM Specific Parameters.gtype" = cluster{"Max (V)": f64, "Min (V)": f64, "V Points": u32, "Current Range (A)": f64, "Autorange": bool, "Sweep Dir": bool, "Current Averages": u32, "Max (A)": f64, "Integration Time": f64, "Cell Area (m^2)": f64}
  "SRM Operation Control.gtype" = enum{"New Measurement", "Load Measurement", "Save Measurement"}
  T5 = cluster{"X Coordinate (mm)": f64, "Z Coordinate (mm)": f64}
  "XZ All Position Cluster.gtype" = cluster{"Cell R.01 Coordinates": T5, "Diffusor Coordinates": T5, "Photodetector Coordinates": T5}
  "IV Full Raw Data.gtype" = cluster{"Rainbow Sweep Types": "Rainbow Sweep Types.gtype", "IV Raw Data Array": "IV Single Measurement.gtype"[]}
uses:
  Rainbow Measurement Setup::Main Functions::Rainbow Measurement::Cell Single Rainbow Measurement::SRM Operation FGV.gvi
  Rainbow Measurement Setup::Main Functions::Instruction Queue::Current State::FGV Current State.gvi
  Rainbow Measurement Setup::Side Functions::Global Abort::FGV Global Abort.gvi
  Rainbow Measurement Setup::Main Functions::Rainbow Measurement::Cell Single Rainbow Measurement::SRM Start Calculator.gvi
  Rainbow Measurement Setup::Main Functions::Rainbow Measurement::Cell Single Rainbow Measurement::LPC Check::SRM Check Light Power Data.gvi
  Rainbow Measurement Setup::Side Functions::Instrument Control::Thorlabs Motors::Dividing Wavelength Control::Dividing Wavelength Calibration Data FGV.gvi
  Rainbow Measurement Setup::Side Functions::Instrument Control::Debug Cluster Instrument Extractor.gvi
  Rainbow Measurement Setup::Main Functions::One Time Calibrations::Beam Power Density::Specific Detect Instruments Subroutine.gvi
  Rainbow Measurement Setup::Side Functions::Instrument Control::Thorlabs Motors::Movement::KCube Move to 0 or Home.gvi
  Rainbow Measurement Setup::Side Functions::Instrument Control::Arduino::XZ Stage Arduino::XZ Stage Initialize And Home.gvi
  Rainbow Measurement Setup::Side Functions::Instrument Control::Arduino::XZ Stage Arduino::XZ Stage Move to Position.gvi
  Rainbow Measurement Setup::Side Functions::Instrument Control::Keithley::Keithley Initialize Subroutine.gvi
  Rainbow Measurement Setup::Main Functions::Rainbow Measurement::Cell Single Rainbow Measurement::SRM Rainbow Sweep.gvi
  Rainbow Measurement Setup::Side Functions::Instrument Control::Thorlabs Motors::Movement::KCube Motors Close.gvi
  Rainbow Measurement Setup::Side Functions::Instrument Control::Keithley::Keithley Close Subroutine.gvi
  Rainbow Measurement Setup::Main Functions::Rainbow Measurement::Cell Single Rainbow Measurement::IV Calculations::SRM IV Parameters Calculator.gvi
  Rainbow Measurement Setup::Main Functions::Rainbow Measurement::Cell Single Rainbow Measurement::Plotting::SRM Sweep Refined Data FGV.gvi
  Rainbow Measurement Setup::Main Functions::Rainbow Measurement::Cell Single Rainbow Measurement::File Handling::SRM Save Graphs Prompt.gvi
  Rainbow Measurement Setup::Main Functions::Rainbow Measurement::Cell Single Rainbow Measurement::File Handling::SRM file handling.gvi
  Rainbow Measurement Setup::Main Functions::Rainbow Measurement::Cell Single Rainbow Measurement::File Handling::SRM Load Prompt.gvi
  Rainbow Measurement Setup::Side Functions::Messages And Prompts::General Simple Prompt.gvi
  Rainbow Measurement Setup::Side Functions::Utilities::Wait ms.gvi
  Rainbow Measurement Setup::Side Functions::Utilities::Progress Handling::Progress FGV.gvi
diagram:
  w1 = $"XZ All Position Cluster"
  # This SubVI Measures the Light power for each motor position for each sweep type and outputs the data so that it can be plotted
  # on the main window for checking and for calibration purposes
  case ($"Error In") {
    frame Error, Default {
      w2 = $"Error In"
      w3 = $"Instrument Coms Info In"
      w4 = $"Debugging Cluster In"
      w5 = $"Instruction Queue In"
      w6 = default
      w7 = $"Rainbow Sweep Param Selector"
    }
    frame No Error {
      call "SRM Operation FGV.gvi"(FGV Instructions="Read State", Error In=$"Error In") -> (SRM Operation Control Out=w8, Error Out=w9)
      Select(s=$"Stand Alone?", t=$"SRM Operation Control", f=w8) -> w10
      call "FGV Current State.gvi"(Current State Instructions="Set Current State and Substate", Current State="Rainbow Single Measurement", Current Substate="", Error In=w9) -> (Error Out=w11)
      s1 = w11  # shift register
      s2 = "Start App"  # shift register
      s2.prev1 = uninitialised  # shift register
      s3 = $"Debugging Cluster In"  # shift register
      s4 = $"Instrument Coms Info In"  # shift register
      s5 = $"Instruction Queue In"  # shift register
      s6 = $"Rainbow Sweep Param Selector"  # shift register
      s7 = "IV Full Raw Data.gtype"[] []  # shift register
      s8 = "IV Full Data Cluster.gtype"[] []  # shift register
      while {
        call "FGV Global Abort.gvi"(Global Abort Instructions="Read Current State", Error In=s1) -> (Local Abort Out=w12, Global Abort Out=w13, Error Out=w14)
        Is Not Equal(x=s2, y="Stop App") -> w15
        Logical And(w15, w12) -> w16
        Select(s=w16, t="Close Coms", f=s2) -> w17
        case (w17) {
          frame "Start App", Default {
            w27 = "Load Light Power Calibration"  # SRM States
            call "FGV Current State.gvi"(Current State Instructions="Set Current Substate", Current Substate="Starting Light Power Calibration", Error In=w14) -> (Error Out=w18)
            w19 = w27
            w20 = default
            w21 = s3
            w22 = s4
            w23 = s5
            w24 = s6
            w25 = s7
            w26 = s8
          }
          frame "Load Light Power Calibration" {
            call "SRM Start Calculator.gvi"(SRM Operation Control=w10, Stand Alone?=$"Stand Alone?") -> (Desired State=w28)
            call "SRM Check Light Power Data.gvi"(Light Power Calibration Data In=$"Light Power Calibration Data", Rainbow Sweep Param Selector In=s6, Input State=w28, Error In=w14) -> (Rainbow Sweep Param Selector Out=w24, Next State=w19, Error Out=w18)
            w20 = default
            w21 = s3
            w22 = s4
            w23 = s5
            w25 = s7
            w26 = s8
          }
          frame "Detect Instruments" {
            w29 = "Initialize Instruments"  # SRM States
            call "FGV Current State.gvi"(Current State Instructions="Set Current Substate", Current Substate="Detecting Instruments", Error In=w14) -> (Error Out=w30)
            call "Dividing Wavelength Calibration Data FGV.gvi"(Div Wavelength FGV Instructions="Load Data", Error In=w30) -> (Error Out=w31)
            call "Debug Cluster Instrument Extractor.gvi"(Debugging Cluster In=s3, Error In=w31) -> (Debuging Cluster Out=w21, Instruments to Detect=w32, Error Out=w33)
            call "Specific Detect Instruments Subroutine.gvi"(Instrument Coms Info In=s4, Error In=w33, Instruments To Detect Array=w32, Stand Alone?=$"Stand Alone?") -> (Instrument Coms Info Out=w22, Error Out=w18)
            w19 = w29
            w20 = default
            w23 = s5
            w24 = s6
            w25 = s7
            w26 = s8
          }
          frame "Initialize Instruments" {
            w34 = "Rainbow Sweep"  # SRM States
            Property Node(instance in=w1) -> ("Cell R.01 Coordinates"=w35)
            call "FGV Current State.gvi"(Current State Instructions="Set Current Substate", Current Substate="Initializing Instruments", Error In=w14) -> (Error Out=w36)
            call "KCube Move to 0 or Home.gvi"(Instrument Coms Info In=s4, Debugging Cluster In=s3, Error In=w36) -> (Instrument Coms Info Out=w37, Debugging Cluster Out=w38, Error Out=w39)
            call "XZ Stage Initialize And Home.gvi"(Instrument Coms Info In=w37, Debugging Cluster In=w38, Error In=w39) -> (Instrument Coms Info Out=w40, Debugging Cluster Out=w41, Error Out=w42)
            call "XZ Stage Move to Position.gvi"(Instrument Coms Info In=w40, Debugging Cluster In=w41, Error In=w42, XZ Coordinate Cluster In=w35) -> (Instrument Coms Info Out=w43, Debugging Cluster Out=w44, Error Out=w45)
            call "Keithley Initialize Subroutine.gvi"(Instrument Coms Info In=w43, Debugging Cluster In=w44, Error In=w45) -> (Instrument Coms Info Out=w22, Debugging Cluster Out=w21, Error Out=w18)
            w19 = w34
            w20 = default
            w23 = s5
            w24 = s6
            w25 = s7
            w26 = s8
          }
          frame "Rainbow Sweep" {
            call "FGV Current State.gvi"(Current State Instructions="Set Current Substate", Current Substate="Acquiring Spectra", Error In=w14) -> (Error Out=w46)
            call "SRM Rainbow Sweep.gvi"(Instrument Coms Info In=s4, Debugging Cluster In=s3, SRM Specific Parameters=$"SRM Specific Parameters", Rainbow Sweep Param Selector=s6, Light Power Calibration Data=$"Light Power Calibration Data", Error In=w46) -> (Instrument Coms Info Out=w22, Debugging Cluster Out=w21, Full IV Curve Raw Data=w25, Error Out=w18)
            w47 = "Close Coms"  # SRM States
            w19 = w47
            w20 = default
            w23 = s5
            w24 = s6
            w26 = s8
          }
          frame "Close Coms" {
            w48 = "Process IV Data"  # SRM States
            w49 = "Stop App"  # SRM States
            Select(s=w12, t=w49, f=w48) -> w19
            call "FGV Current State.gvi"(Current State Instructions="Set Current Substate", Current Substate="Closing Coms", Error In=w14) -> (Error Out=w50)
            call "KCube Motors Close.gvi"(Instrument Coms Info In=s4, Error In=w50) -> (Instrument Coms Info Out=w51, Error Out=w52)
            call "Keithley Close Subroutine.gvi"(Instrument Coms Info In=w51, Debugging Cluster In=s3, Error In=w52) -> (Instrument Coms Info Out=w22, Debugging Cluster Out=w21, Error Out=w18)
            w20 = default
            w23 = s5
            w24 = s6
            w25 = s7
            w26 = s8
          }
          frame "Process IV Data" {
            call "SRM IV Parameters Calculator.gvi"(IV Raw Data Array=s7, Error In=w14) -> (IV Full Data Cluster Array=w26, Error Out=w53)
            call "SRM Sweep Refined Data FGV.gvi"(IV Full Data Cluster Array In=w26, Error In=w53, FGV Instructions="Set State") -> (Error Out=w54)
            call "SRM Save Graphs Prompt.gvi"(Previous State=s2.prev1, Error In=w54) -> (Desired State=w19, Error Out=w18)
            w20 = default
            w21 = s3
            w22 = s4
            w23 = s5
            w24 = s6
            w25 = s7
          }
          frame "Load Measurement" {
            call "FGV Current State.gvi"(Current State Instructions="Set Current Substate", Current Substate="Loading Calibration", Error In=w14) -> (Error Out=w55)
            call "SRM file handling.gvi"(Default Data Saving Location=$"Default Data Saving Location", Modify File Operation="Load TXT", Error In=w55) -> (Duplicate Measurement Files?=w56, Found Files Within all Folders?=w57, IV Full Raw Data Out=w25, Found Any Folder?=w58, Loaded Files=w59, Error Out=w60, Canceled Loading?=w61)
            call "SRM Load Prompt.gvi"(Duplicate Measurement Folders?=w56, Found Any Folder?=w58, Found Files within each Folder?=w57, Loaded Files=w59, Error In=w60, Canceled Loading?=w61) -> (Desired State=w19, Error Out=w18)
            w20 = default
            w21 = s3
            w22 = s4
            w23 = s5
            w24 = s6
            w26 = s8
          }
          frame "Save Graphs" {
            call "FGV Current State.gvi"(Current State Instructions="Set Current Substate", Current Substate="Saving Graphs", Error In=w14) -> (Error Out=w62)
            w63 = "Your Measurement Files Have been saved\npropperly on your personal data folder."
            call "General Simple Prompt.gvi"(Prompt Message=w63, Okay Button Message="Perfect Thanks :)", Error In=w62, Prompt?=TRUE) -> (Error Out=w64)
            call "SRM file handling.gvi"(Default Data Saving Location=$"Default Data Saving Location", IV Full Data Cluster=s8, Modify File Operation="Save TXT", Error In=w64, Cell Naming Cluster=$"Cell Naming Cluster") -> (Error Out=w18)
            w65 = "Stop App"  # SRM States
            w19 = w65
            w20 = default
            w21 = s3
            w22 = s4
            w23 = s5
            w24 = s6
            w25 = s7
            w26 = s8
          }
          frame "Enqueue Light Calibration" {
            w66 = "Stop App"  # SRM States
            Enqueue Element(element="Light Power Calibration", error in=w14, queue=s5) -> (error out=w67, queue out=w23)
            Property Node(instance in=$"Rainbow Tab Reference", "ValueSignaling"=0, error in=w67) -> (error out=w68)
            call "Wait ms.gvi"(Error In=w68, Milliseconds to Wait=250) -> (Error Out=w18)
            w19 = w66
            w20 = default
            w21 = s3
            w22 = s4
            w24 = s6
            w25 = s7
            w26 = s8
          }
          frame "Stop App" {
            w69 = "Start App"  # SRM States
            call "FGV Current State.gvi"(Current State Instructions="Set Current Substate", Current Substate="Stopping Apps", Error In=w14) -> (Error Out=w18)
            w19 = w69
            w20 = TRUE
            w21 = s3
            w22 = s4
            w23 = s5
            w24 = s6
            w25 = s7
            w26 = s8
          }
        }
        call "Progress FGV.gvi"(FGV Instructions="Set State", Progress In=0, Error In=w18) -> (Error Out=w70)
        Logical Or(w13, w70, w20) -> w71
        next s1 = w70
        next s2 = w19
        next s3 = w21
        next s4 = w22
        next s5 = w23
        next s6 = w24
        next s7 = w25
        next s8 = w26
        stop if w71
      }
      w2 = s1
      w3 = s4
      w4 = s3
      w5 = s5
      w6 = s8
      w7 = s6
    }
  }
  $"Instruction Queue Out" <- w5
  $"SRM Rainbow Parameters" <- w7
  $"FulL IV data Cluster" <- w6
  $"Instuments Coms Info Out" <- w3
  $"Debugging Cluster Out" <- w4
  $"Error Out" <- w2
