vi "Light Calibration file handling.gvi"   [LabVIEW NXG 5.0.0]
inputs:
  "Error In": error
  "Default Data Saving Location": path
  "Modify File Operation": "Modify File Operation.gtype" = "Save TXT"
  "Light Power Calibration Data In": "Light Power Calibration Data.gtype"[]
  "Cell Naming Cluster": "Cell Naming Cluster.gtype"
outputs:
  "Error Out": error
  "Light Power Calibration Data Out": "Light Power Calibration Data.gtype"[]
  "Found Any File?": bool
types:
  "Modify File Operation.gtype" = enum{"Save TXT", "Load TXT"}
  T1 = cluster{"Dividing Wavelength Array": f64[], "Measured Power Array": f64[]}
  "Rainbow Sweep Types.gtype" = enum{"Red Sweep Closing", "Red Sweep Opening", "Blue Sweep Closing", "Blue Sweep Opening"}
  "Light Power Calibration Data.gtype" = cluster{"Single Light Calibration": T1, "Rainbow Sweep Types": "Rainbow Sweep Types.gtype"}
  "Cell Naming Cluster.gtype" = cluster{"Cell Label": string, "Sample Prefix": string, "Author Initials": string, "Current Date": string, "Batch Name": string}
uses:
  Rainbow Measurement Setup::Side Functions::Messages And Prompts::Select path prompt.gvi
  Rainbow Measurement Setup::Side Functions::Path Manipulation::Filename Scan For Sweep.gvi
  Rainbow Measurement Setup::Main Functions::Modify TXT file::Modify Measurement TXT File.gvi
diagram:
  # This subVI Handles the Saving of all the MSpot Spectra Calibration Files
  case ($"Error In") {
    frame Error, Default {
      w1 = $"Error In"
      w2 = default
      w3 = $"Light Power Calibration Data In"
    }
    frame No Error {
      case ($"Modify File Operation") {
        frame "Load TXT" {
          w4 = "Please Select the folder with all the Light Power Calibration Files you want\nto Load. "
          w5 = "(All available Calibration  Files Will be Loaded Automatically)"
          call "Select path prompt.gvi"(Main Message=w4, Sub message=w5, Error In=$"Error In") -> (New Path=w6, Error Out=w7)
          List Folder(error in=w7, path=w6) -> (error out=w8, file names=w9, path out=w10)
          s1 = w8  # shift register
          s2 = 0  # shift register
          s3 = "Light Power Calibration Data.gtype"[] []  # shift register
          for {
            w11 = each element of w9
            Build Path(base path=w10, name or relative path=w11) -> (appended path=w13)
            Search And Replace String(error in (no error)=s1, input string=w11, search string="Power_Calibration") -> (error out=w14, number of replacements=w15)
            call "Filename Scan For Sweep.gvi"(FileName In=w11, Error In=w14) -> (Is File sweep type?=w16, Sweep Type=w17, Error Out=w18)
            Is Not Equal To 0(x=w15) -> w19
            Logical And(w19, w16) -> w20
            case (w20) {
              frame False, Default {
                w21 = s2
                w22 = s3
                w23 = w18
                w24 = default
              }
              frame True {
                Array Index(array=s3) -> (out0[s2]=w25)
                call "Modify Measurement TXT File.gvi"(Filename to load/save=w13, Modify File Operation=$"Modify File Operation", Error In=w18, Measurement File Type="Light Calibration Power") -> (Loaded Data=w26, Error Out=w23)
                Array Index(array=w26) -> (out0[_, 0]=w27, out1[_, 1]=w28)
                Property Node(instance in=w25, "Single Light Calibration:Dividing Wavelength Array"=w27, "Single Light Calibration:Measured Power Array"=w28, "Rainbow Sweep Types"=w17) -> (instance out=w29)
                Insert Into Array(inArray=s3, new=w29) -> w22
                Increment(x=s2) -> w21
                w24 = TRUE
              }
            }
            append w24 to w12
            next s1 = w23
            next s2 = w21
            next s3 = w22
          }
          Or Array Elements(Boolean array=w12) -> (logical OR=w2)
          w1 = s1
          w3 = s3
        }
        frame "Save TXT", Default {
          s4 = $"Error In"  # shift register
          for {
            w30 = each element of $"Light Power Calibration Data In"
            Property Node(instance in=w30) -> ("Single Light Calibration"=w31, "Rainbow Sweep Types"=w32)
            Property Node(instance in=w31) -> ("Dividing Wavelength Array"=w33, "Measured Power Array"=w34)
            Build Array(w33, w34) -> w35
            Transpose 2D Array(2D array=w35) -> (transposed array=w36)
            call "Modify Measurement TXT File.gvi"(Rainbow Sweep Types=w32, Default Data Saving Location=$"Default Data Saving Location", Modify File Operation=$"Modify File Operation", Data To Save=w36, Error In=s4, Cell Naming Cluster=$"Cell Naming Cluster", Measurement File Type="Light Calibration Power") -> (Error Out=w37)
            next s4 = w37
          }
          w1 = s4
          w2 = default
          w3 = $"Light Power Calibration Data In"
        }
      }
    }
  }
  $"Found Any File?" <- w2
  $"Light Power Calibration Data Out" <- w3
  $"Error Out" <- w1
