vi "Light Power Calibration Sweep.gvi"   [LabVIEW NXG 5.0.0]
inputs:
  "Error In": error
  "Instrument Coms Info In": "Instrument Coms Info.gtype"
  "Debugging Cluster In": "Debugging Cluster.gtype"
  "Rainbow Sweep Param Selector": "Rainbow Sweep Param Selector.gtype" = {0, 1100, 300, 1, 1, 0}
outputs:
  "Error Out": error
  "Instrument Coms Info Out": "Instrument Coms Info.gtype"
  "Debugging Cluster Out": "Debugging Cluster.gtype"
  "Light Power Calibration Data": "Light Power Calibration Data.gtype"[]
types:
  "Raibow Sweep Selector.gtype" = enum{"Red Sweep", "Blue Sweep", "Full Sweep Red First", "Full Sweep Blue First"}
  T1 = enum{"Red Sweep Closing", "Red Sweep Opening", "Red Sweep Both Ways"}
  T2 = enum{"Blue Sweep Opening", "Blue Sweep Closing", "Blue Sweep Both Ways"}
  "Rainbow Sweep Type Selector.gtype" = cluster{"Red Sweep Mode": T1, "Blue Sweep Mode": T2}
  "Rainbow Sweep Param Selector.gtype" = cluster{"Raibow Sweep Selector": "Raibow Sweep Selector.gtype", "Max Wavelength (nm)": f64, "Min Wavelength (nm)": f64, "Wavelength Step (nm)": f64, "Rainbow Sweep Type Selector": "Rainbow Sweep Type Selector.gtype"}
  "Insturment Debugging Cluster.gtype" = cluster{"Keithley": bool, "Arduinos": bool, "Thorlabs Motors": bool, "Photodetector": bool, "Flame Spectr": bool}
  "Debugging Cluster.gtype" = cluster{"Debugging mode?": bool, "Initialize App": bool, "Insturment Debugging": "Insturment Debugging Cluster.gtype"}
  T3 = cluster{"Element 1": "VISA Instr", "Element 2": string}
  "Arduino Detection cluster control.gtype" = cluster{"XZ Stage Arduino Address": "VISA Instr", "XZ Stage Arduino Detected?": bool, "Multiplexer Arduino Detected?": bool, "Multiplexer Arduino Address": "VISA Instr", "Arduinos List": T3[], "XZ Stage Log": string, "Multiplexer Log": string}
  "Thorlabs Motors Serial Number In.gtype" = cluster{"Thorlabs Blue Motor": string, "Thorlabs Red Motor": string, "Blue Motor Homed?": bool, "Red Motor Homed?": bool}
  "Instrument Coms Info.gtype" = cluster{"Arduino Coms Info": "Arduino Detection cluster control.gtype", "Photodetector Names": string[], "Keythley Address": "VISA Instr", "Photodetector Detected?": bool, "Thorlabs Motors Detected?": bool, "Keithley Detected?": bool, "Thorlabs Motors Serial Number": "Thorlabs Motors Serial Number In.gtype", "Photodetector IVI session": "Ivi IviDefault", "Flame ID": string, "Flame Detected?": bool, "Flame Wrapper ID": u64}
  T4 = cluster{"Dividing Wavelength Array": f64[], "Measured Power Array": f64[]}
  "Rainbow Sweep Types.gtype" = enum{"Red Sweep Closing", "Red Sweep Opening", "Blue Sweep Closing", "Blue Sweep Opening"}
  "Light Power Calibration Data.gtype" = cluster{"Single Light Calibration": T4, "Rainbow Sweep Types": "Rainbow Sweep Types.gtype"}
  "LPC Sweep Live Parameters.gtype" = cluster{"Light Power (W) ": f64, "Current Wavelength (nm)": f64, "Rainbow Sweep Types": "Rainbow Sweep Types.gtype"}
uses:
  Rainbow Measurement Setup::Side Functions::Messages And Prompts::FGV Cancel Prompts until Finished Routine.gvi
  Rainbow Measurement Setup::Side Functions::Rainbow Sweep::Rainbow Sweep Param Generator.gvi
  Rainbow Measurement Setup::Side Functions::Instrument Control::Thorlabs Motors::Dividing Wavelength Control::Dividing Wavelength Calibration Data FGV.gvi
  Rainbow Measurement Setup::Side Functions::Global Abort::FGV Global Abort.gvi
  Rainbow Measurement Setup::Side Functions::Instrument Control::Thorlabs Motors::Dividing Wavelength Control::KCube Dividing Wavelength Translator.gvi
  Rainbow Measurement Setup::Side Functions::Utilities::Wait ms.gvi
  Rainbow Measurement Setup::Side Functions::Instrument Control::Photodetector::Photodetector Measure Power.gvi
  Rainbow Measurement Setup::Side Functions::Graphing::Multiple Page Graph Adapter.gvi
  Rainbow Measurement Setup::Main Functions::Rainbow Measurement::Light Power Calibration::Light Calibration Live Parameters FGV.gvi
  Rainbow Measurement Setup::Side Functions::Utilities::Progress Handling::Progress General Calculator.gvi
  Rainbow Measurement Setup::Side Functions::Utilities::Progress Handling::Progress FGV.gvi
diagram:
  # This SubVI Performs a sweep moving the motors and measuring the power that reaches the detector and then it stores everything on an array so that it can be later saved.
  case ($"Error In") {
    frame Error, Default {
      w1 = $"Error In"
      w2 = default
      w3 = $"Instrument Coms Info In"
      w4 = $"Debugging Cluster In"
    }
    frame No Error {
      call "FGV Cancel Prompts until Finished Routine.gvi"(Error In=$"Error In", FGV Instructions="Reset State") -> (Error Out=w5)
      call "Rainbow Sweep Param Generator.gvi"(Rainbow Sweep Parameters=$"Rainbow Sweep Param Selector", Error In=w5) -> (Rainbow Sweep Parameters Array=w6, Error Out=w7)
      call "Dividing Wavelength Calibration Data FGV.gvi"(Div Wavelength FGV Instructions="Read Loaded Data", Error In=w7) -> (Dividing Wavelength Calibration Data Out=w8, Error Out=w9)
      Property Node(instance in=$"Rainbow Sweep Param Selector") -> ("Wavelength Step (nm)"=w10)
      Multiply(w10, 1000) -> w11
      s1 = w9  # shift register
      s2 = $"Instrument Coms Info In"  # shift register
      s3 = $"Debugging Cluster In"  # shift register
      s4 = "Light Power Calibration Data.gtype"[] []  # shift register
      s5 = f64[][][] []  # shift register
      s6 = 0  # shift register
      for (N -> w12) {
        w13 = each element of w6
        Property Node(instance in=w13) -> ("Dividing Wavelength Array"=w14, "Rainbow Sweep Types"=w15)
        s7 = s2  # shift register
        s8 = s1  # shift register
        s9 = s3  # shift register
        s10 = T4 {all zero or empty}  # shift register
        s11 = f64[][] []  # shift register
        s12 = s6  # shift register
        for (N -> w16) (iteration -> i1) {
          w17 = each element of w14
          Increment(x=s12) -> w18
          Property Node(instance in=s10) -> ("Dividing Wavelength Array"=w19, "Measured Power Array"=w20, instance out=w21)
          call "FGV Global Abort.gvi"(Global Abort Instructions="Read Current State", Error In=s8) -> (Local Abort Out=w22, Global Abort Out=w23, Error Out=w24)
          call "KCube Dividing Wavelength Translator.gvi"(Debugging Cluster=s9, Dividing Wavelength=w17, Instrument Coms Info In=s7, Dividing Wavelength Calibration Data In=w8, Error In=w24, Rainbow Sweep Types=w15) -> (Real Dividing Wavelength=w25, Instrument Coms Info Out=w26, Error Out=w27)
          Insert Into Array(inArray=w19, index0=i1, new=w25) -> w28
          call "Wait ms.gvi"(Error In=w27, Milliseconds to Wait=w11) -> (Error Out=w29)
          call "Photodetector Measure Power.gvi"(Instrument Coms Info In=w26, Debugging Cluster In=s9, Error In=w29) -> (Instrument Coms Info Out=w30, Debugging Cluster Out=w31, Measured Power=w32, Error Out=w33)
          Insert Into Array(inArray=w20, index0=i1, new=w32) -> w34
          Property Node(instance in=w21, "Dividing Wavelength Array"=w28, "Measured Power Array"=w34) -> (instance out=w35)
          Multiply(w16, w12) -> w36
          Property Node(instance in="LPC Sweep Live Parameters.gtype" {all zero or empty}, "Light Power (W) "=w32, "Current Wavelength (nm)"=w25, "Rainbow Sweep Types"=w15) -> (instance out=w37)
          Build Array(w25, w32) -> w38
          Build Array(s11, w38) -> w39
          Insert Into Array(inArray=s5, new=w39) -> w40
          call "Multiple Page Graph Adapter.gvi"(Input XY data Multi Page=w40, Error In=w33) -> (Output Bundled Data=w41, Output Graph Ready Data=w42, Error Out=w43)
          call "Light Calibration Live Parameters FGV.gvi"(FGV Instructions="Set State", Light Calibration Live Parameters In=w37, Output Graph Ready Data=w42, Error In=w43, Graph Bundled data=w41) -> (Error Out=w44)
          call "Progress General Calculator.gvi"(Starting Value=40, Ending Value=80, Number Of Steps=w36, Current Step=s12, Error In=w44) -> (Current Progress=w45, Error Out=w46)
          call "Progress FGV.gvi"(FGV Instructions="Set State", Progress In=w45, Error In=w46) -> (Error Out=w47)
          Logical Or(w22, w23) -> w48
          next s7 = w30
          next s8 = w47
          next s9 = w31
          next s10 = w35
          next s11 = w39
          next s12 = w18
          stop if w48
        }
        Property Node(instance in="Light Power Calibration Data.gtype" {all zero or empty}, "Single Light Calibration"=s10, "Rainbow Sweep Types"=w15) -> (instance out=w49)
        Insert Into Array(inArray=s4, new=w49) -> w50
        call "Multiple Page Graph Adapter.gvi"(Input XY data Multi Page=w40, Full Data Array=w50, Error In=s8) -> (Output Bundled Data=w51, Output Graph Ready Data=w52, Error Out=w53)
        call "Light Calibration Live Parameters FGV.gvi"(FGV Instructions="Set State", Light Calibration Live Parameters In=w37, Output Graph Ready Data=w52, Error In=w53, Graph Bundled data=w51) -> (Error Out=w54)
        next s1 = w54
        next s2 = s7
        next s3 = s9
        next s4 = w50
        next s5 = w40
        next s6 = s12
        stop if w48
      }
      w1 = s1
      w2 = s4
      w3 = s2
      w4 = s3
    }
  }
  $"Debugging Cluster Out" <- w4
  $"Light Power Calibration Data" <- w2
  $"Error Out" <- w1
  $"Instrument Coms Info Out" <- w3
