vi "Main Window.gvi"   [LabVIEW NXG 5.0.0]
panel controls:
  "Main Tab": i32
  "Light Calibration Tab": i32
  "New Spectrum Calibration": bool
  "Load Spectrum Calibration": bool
  "Save Spectrum Calibration": bool
  "Initialize App Bundle Cluster": "Initialize App Bundle Cluster.gtype"
  "Configuration Tab": i32
  "Abort Button": bool
  "Exit App Button": bool
  "Debugging Cluster": "Debugging Cluster.gtype"
  "Rainbow Measurement tab": i32
  "Instrument Coms Info": "Instrument Coms Info.gtype"
  "Rainbow Sweep Param Selector MSpot": "Rainbow Sweep Param Selector.gtype" = {0, 1100, 300, 1, 1, 0}
  "Check Dividing Wavelength Calibration": bool
  "New Dividing Wavelength Calibration": bool
  "Load Dividing Wavelength Calibration": bool
  "MSpot Sperctrum Calibration Parameters": "MSpot Spectrum Calibration Parameters.gtype" = {"Min Position (mm)"=0, "Max Position (mm)"=50, "Position step size (mm)"=0.1, "Manual Spectra?"=FALSE, "Flame Integration Time (us)"=1000, "Flame Scans to Average"=1000}
  "New Light Power Calibration": bool
  "Load Light Power Calibration": bool
  "Save Light Power Calibration": bool
  "Rainbow Sweep Parameters LPC": "Rainbow Sweep Param Selector.gtype" = {0, 900, 400, 1, 1, 0}
  "Default Data Saving Location": path = path "C:\\Users\\minus\\Documents\\LabVIEW Projects\\Rainbow_NXG\\File tests"
  "Light Power Calibration Data": "Light Power Calibration Data.gtype"[]
  "Cell Naming Cluster": "Cell Naming Cluster.gtype"
  "Custom date": bool
  "Author Initials": string
  "Batch Name": string
  "Cell Number": string
  "Sample Comments": string
  "Current Date": string
  "Acquire Single Rainbow Button": bool
  "Load Single Measurement": bool
  "Save Single Measurement": bool
  "Rainbow Sweep Parameters RSM": "Rainbow Sweep Param Selector.gtype" = {0, 900, 400, 1, 1, 0}
  "LPC Parameters": "Light power Calibration Parameters.gtype" = {"Powermeter Averages"=3}
  "SRM Raw Plot Rainbow Sweep Selector": string
  "SRM Refined Plot Rainbow Sweep Types": string
  "XZ All Position Cluster": "XZ All Position Cluster.gtype" = {146, 32.6, 188, 30, 39, 70}
  "Save Coordinates": bool
  "Main Tab": i32 = 1
  "SRM Plot Parameter Selector": "SRM Refined Plot Parameter Selector.gtype" = "Efficiency (%)"
  "SRM Specific Parameters": "SRM Specific Parameters.gtype" = {"Max (V)"=1.2, "Min (V)"=-0.2, "V Points"=100, "Current Range (A)"=0.1, "Autorange"=TRUE, "Sweep Dir"=FALSE, "Current Averages"=3, "Max (A)"=1, "Integration Time"=0.5, "Cell Area (m^2)"=8e-06}
  "Full Reference Cluster": "Full Reference Cluster.gtype"
  "Full Beam Multispectral Data Array": "Full MSpot Multispectral Data.gtype"[]
  "X position": f64
  "Z position": f64
  "Activate XZ Stage": bool
  "Set Postion": bool
  "Release XZ Stage": bool
  "XZ Stage Active": bool
  "XZ Stage Cell": T6 = "L.01"
  "Custom Position": bool
panel indicators:
  "Irradiance Calibration": f64[]
  "Current State": "Queue Instructions Control.gtype"
  "Current Sub State": string
  "Beam Power Density": f64[][]
  "Path Where the Calibration Files Will Be Stored (Can't Be Changed)": path
  "Desired MSpot Calibration Operation": "Calibration Operation Control.gtype"
  "Light Power Calibration": cluster{"Wavelength": f64[], "Power": f64[]}[]
  "Sample Prefix": string
  "Progress %": f64
  "Progress counter": f64
  "State": string
  "Substate": string
  "Label Info Error Label": string
  "Label Info Missing Error": bool
  "IV Plot Out": "SRM Single Plot Cluster.gtype"[]
  "FulL IV data Cluster": "IV Full Data Cluster.gtype"[]
  "IV Extracted Parameter Plot": T4
  "Sweep Live Parameters LPC": "LPC Sweep Live Parameters.gtype"
  "Sweep Live Parameters RSM": "SRM Sweep Live Parameters.gtype"
types:
  "Instrument Coms Info.gtype" = cluster{"Arduino Coms Info": "Arduino Detection cluster control.gtype", "Photodetector Names": string[], "Keythley Address": "VISA Instr", "Photodetector Detected?": bool, "Thorlabs Motors Detected?": bool, "Keithley Detected?": bool, "Thorlabs Motors Serial Number": "Thorlabs Motors Serial Number In.gtype", "Photodetector IVI session": "Ivi IviDefault", "Flame ID": string, "Flame Detected?": bool, "Flame Wrapper ID": u64}
  "Full Reference Cluster.gtype" = cluster{"Enum Reference Cluster": "Enum Control Reference Cluster.gtype", "Boolean Reference Cluster": "Boolean Control Reference Cluster.gtype", "Numeric Reference Cluster": "Numeric Control Reference Cluster.gtype", "Numeric Cluster Reference Cluster": "Numeric Cluster Reference Cluster.gtype", "Path Reference Cluster": "Path Reference Cluster.gtype", "Cluster Reference Cluster": "Cluster Reference Cluster.gtype", "XZ Stage Controls Reference Cluster": "XZ Stage Controls Reference Cluster.gtype"}
  "Debugging Cluster.gtype" = cluster{"Debugging mode?": bool, "Initialize App": bool, "Insturment Debugging": "Insturment Debugging Cluster.gtype"}
  "All Paths Cluster.gtype" = cluster{"Thorlabs Motor Serial Number File Path": path}
  "Initialize App Bundle Cluster.gtype" = cluster{"Instrument Coms Info": "Instrument Coms Info.gtype", "Full Reference Cluster": "Full Reference Cluster.gtype", "Debugging Cluster": "Debugging Cluster.gtype", "All Paths": "All Paths Cluster.gtype"}
  "Queue Instructions Control.gtype" = enum{"Undefined State", "Debug Check", "Initialize App", "Idle", "Light Power Calibration", "Rainbow Single Measurement", "Light Calibration Irradiance", "Light Calibration Spectral Density", "Light Calibration Power Density", "MSpot Spectrum Calibration", "Move XZ Stage", "Access TXT File", "Stop App"}
  "Raibow Sweep Selector.gtype" = enum{"Red Sweep", "Blue Sweep", "Full Sweep Red First", "Full Sweep Blue First"}
  T1 = enum{"Red Sweep Closing", "Red Sweep Opening", "Red Sweep Both Ways"}
  T2 = enum{"Blue Sweep Opening", "Blue Sweep Closing", "Blue Sweep Both Ways"}
  "Rainbow Sweep Type Selector.gtype" = cluster{"Red Sweep Mode": T1, "Blue Sweep Mode": T2}
  "Rainbow Sweep Param Selector.gtype" = cluster{"Raibow Sweep Selector": "Raibow Sweep Selector.gtype", "Max Wavelength (nm)": f64, "Min Wavelength (nm)": f64, "Wavelength Step (nm)": f64, "Rainbow Sweep Type Selector": "Rainbow Sweep Type Selector.gtype"}
  "Calibration Operation Control.gtype" = enum{"Check Calibration", "Load Calibration", "New Calibration"}
  "MSpot Spectrum Calibration Parameters.gtype" = cluster{"Min Position (mm)": f64, "Max Position (mm)": f64, "Position step size (mm)": f64, "Manual Spectra?": bool, "Flame Integration Time (us)": f64, "Flame Scans to Average": u32}
  T3 = cluster{"Dividing Wavelength Array": f64[], "Measured Power Array": f64[]}
  "Rainbow Sweep Types.gtype" = enum{"Red Sweep Closing", "Red Sweep Opening", "Blue Sweep Closing", "Blue Sweep Opening"}
  "Light Power Calibration Data.gtype" = cluster{"Single Light Calibration": T3, "Rainbow Sweep Types": "Rainbow Sweep Types.gtype"}
  "Cell Naming Cluster.gtype" = cluster{"Cell Label": string, "Sample Prefix": string, "Author Initials": string, "Current Date": string, "Batch Name": string}
  "SRM Single Plot Cluster.gtype" = cluster{"Voltage": f64[], "Current Density": f64[]}
  "Light power Calibration Parameters.gtype" = cluster{"Powermeter Averages": f64}
  "IV Single Measurement.gtype" = cluster{"Voltage": f64[], "Current": f64[], "Current Density": f64[], "Dividing Wavelength": f64, "Light Power": f64}
  "IV Refined Full Sweep Data.gtype" = cluster{"Rs (Ω/m^2)": f64[], "Rsh (Ω/m^2)": f64[], "Jsc (A/m^2)": f64[], "Voc (V)": f64[], "FF (%)": f64[], "Efficiency (%)": f64[], "Dividing Wavelength (nm)": f64[], "Light Power (W)": f64[]}
  "IV Full Data Cluster.gtype" = cluster{"IV Measurements Array": "IV Single Measurement.gtype"[], "Rainbow Sweep Types": "Rainbow Sweep Types.gtype", "IV Refined Data": "IV Refined Full Sweep Data.gtype"}
  T4 = cluster{"Dividing Wavelength (nm)": f64[], "Element 2": f64[]}
  T5 = cluster{"X Coordinate (mm)": f64, "Z Coordinate (mm)": f64}
  "XZ All Position Cluster.gtype" = cluster{"Cell R.01 Coordinates": T5, "Diffusor Coordinates": T5, "Photodetector Coordinates": T5}
  "LPC Sweep Live Parameters.gtype" = cluster{"Light Power (W) ": f64, "Current Wavelength (nm)": f64, "Rainbow Sweep Types": "Rainbow Sweep Types.gtype"}
  "SRM Refined Plot Parameter Selector.gtype" = enum{"Efficiency (%)", "Jsc (A)", "Voc (V)", "Light Power (W)", "FF (%)", "Rs (Ω/m^2)", "Rsh (Ω/m^2)"}
  "SRM Specific Parameters.gtype" = cluster{"Max (V)": f64, "Min (V)": f64, "V Points": u32, "Current Range (A)": f64, "Autorange": bool, "Sweep Dir": bool, "Current Averages": u32, "Max (A)": f64, "Integration Time": f64, "Cell Area (m^2)": f64}
  "SRM Sweep Live Parameters.gtype" = cluster{"Current Wavelength (nm)": f64, "Rainbow Sweep Types": "Rainbow Sweep Types.gtype", "Finished Measurement?": bool}
  "MSpot Spectrum Data.gtype" = cluster{"M Spot Spectrum": cluster{"Wavelength": f64[], "Counts": f64[]}, "Blue Motor Position (mm)": f64, "Red Motor Position (mm)": f64, "Dividing Wavelength (nm)": f64}
  "Full MSpot Multispectral Data.gtype" = cluster{"MSpot Spectrum Data Array": "MSpot Spectrum Data.gtype"[], "Rainbow Sweep Types": "Rainbow Sweep Types.gtype"}
  T6 = enum{"L.01", "L.02", "L.03", "L.04", "L.05", "L.06", "L.07", "L.08", "L.09", "L.10", "L.11", "L.12", "R.01", "R.02", "R.03", "R.04", "R.05", "R.06", "R.07", "R.08", "R.09", "R.10", "R.11", "R.12"}
  "Enum Control Reference Cluster.gtype" = cluster{"Main Tab": "TabControl reference", "Rainbow Measurement tab": "TabControl reference", "Configuration tab": "TabControl reference", "Light Calibration tab": "TabControl reference", "SRM Plot Parameter Selector": "EnumSelector reference"}
  "Boolean Control Reference Cluster.gtype" = cluster{"Custem date": "CheckBox reference", "Label Info Missing Error": "BooleanControl reference"}
  "Numeric Control Reference Cluster.gtype" = cluster{"Beam Power Density": "IntensityGraph reference"[][], "Irradiance Calibration": "Graph reference"[]}
  "Numeric Cluster Reference Cluster.gtype" = cluster{"LPC Parameters": "Cluster reference", "Sweep Live Parameters LPC": "Cluster reference"}
  "Path Reference Cluster.gtype" = cluster{"Calibration Files Path": "PathSelector reference", "Default Data Saving Location": "PathSelector reference"}
  "Cluster Reference Cluster.gtype" = cluster{"Light Power Calibration": "Graph reference", "Light Power Calibration Data": "ArrayViewer reference", "Rainbow Sweep Parameters RSM": "Cluster reference", "Rainbow Sweep Param Selector MSpot": "Cluster reference", "MSpot Spectrum Calibration Parameters": "Cluster reference", "SRM Raw Plot Rainbow Sweep Selector": "ComboBoxSelector reference", "SRM Refined Plot Rainbow Sweep Types": "ComboBoxSelector reference", "SRM Specific Parameters": "Cluster reference", "XZ All Position Cluster": "Cluster reference", "Label Info Error Label": "StringControl reference", "Sample Comments": "StringControl reference", "Cell Number": "StringControl reference", "Author Initials": "ComboBoxSelector reference", "Batch Name": "StringControl reference", "IV Plot Out ": "Graph reference", "Sweep Live Parameters RSM": "Cluster reference"}
  "XZ Stage Controls Reference Cluster.gtype" = cluster{"Cell Label": "EnumSelector reference", "Z Position": "NumericTextBoxDouble reference", "X Position": "NumericTextBoxDouble reference", "Activate XZ Stage": "BooleanControl reference", "Custom Position": "BooleanControl reference", "Set Position": "BooleanControl reference", "XZ Stage Active": "BooleanControl reference", "Release XZ Stage": "BooleanControl reference"}
  "Sample Naming Cluster.gtype" = cluster{"Author Initials": string, "Batch Name": string, "Sample Comments": string, "Main Tab control": i32, "Rainbow Measurement tab": i32, "Cell Number": string, "Cell Number ref": "StringControl reference", "Custom date": bool, "Current Date": string, "Current Date ref": "StringControl reference"}
uses:
  Rainbow Measurement Setup::Side Functions::Global Abort::FGV Global Abort.gvi
  Rainbow Measurement Setup::Main Functions::Instruction Queue::Current State::FGV Current State.gvi
  Rainbow Measurement Setup::Main Functions::Debugging::Debugging Prompt.gvi
  Rainbow Measurement Setup::Main Functions::Initialize App::Initialize App Bundle In.gvi
  Rainbow Measurement Setup::Main Functions::Initialize App::Initialize app subroutine.gvi
  Rainbow Measurement Setup::Main Functions::Initialize App::Initialize App Bundle Out.gvi
  Rainbow Measurement Setup::Side Functions::Utilities::Progress Handling::Progress FGV.gvi
  Rainbow Measurement Setup::Main Functions::One Time Calibrations::MSpot Spectrum::File Handling::MSpot Folder Check.gvi
  Rainbow Measurement Setup::Main Functions::One Time Calibrations::MSpot Spectrum::MSpot Spectrum Calibration Subroutine.gvi
  Rainbow Measurement Setup::Main Functions::Rainbow Measurement::Light Power Calibration::Light Power Calibration Subroutine.gvi
  Rainbow Measurement Setup::Main Functions::Rainbow Measurement::Cell Single Rainbow Measurement::Single Rainbow Measurement Subroutine.gvi
  NI::G Core::Error::Is Error.gvi
  Rainbow Measurement Setup::Side Functions::Global Abort::Global Abort Sequence.gvi
  Rainbow Measurement Setup::Main Functions::Rainbow Measurement::Cell Single Rainbow Measurement::SRM Live Parameters::SRM Sweep Live Reference Clustering.gvi
  Rainbow Measurement Setup::Main Functions::Rainbow Measurement::Cell Single Rainbow Measurement::SRM Live Parameters::SRM Sweep Live Parameters FGV.gvi
  Rainbow Measurement Setup::Main Functions::Rainbow Measurement::Cell Single Rainbow Measurement::Plotting::SRM Sweep Refined Data FGV.gvi
  Rainbow Measurement Setup::Main Functions::Rainbow Measurement::Light Power Calibration::Light Calibration Live Parameters FGV.gvi
  Rainbow Measurement Setup::Side Functions::Timeout Sequence.gvi
  Rainbow Measurement Setup::Side Functions::Exit App Sequence.gvi
  Rainbow Measurement Setup::Main Functions::Instruction Queue::Check Queue And Label.gvi
  Rainbow Measurement Setup::Main Functions::Instruction Queue::Conditional Enqueue.gvi
  Rainbow Measurement Setup::Main Functions::One Time Calibrations::MSpot Spectrum::MSpot Calibration Operation Translator.gvi
  Rainbow Measurement Setup::Side Functions::Sample Naming::Sample Name Checkup Subroutine.gvi
  Rainbow Measurement Setup::Side Functions::Sample Naming::Sample Prefix FGV.gvi
  Rainbow Measurement Setup::Main Functions::Rainbow Measurement::Light Power Calibration::Light Power Calibration Operation Translator.gvi
  Rainbow Measurement Setup::Main Functions::Rainbow Measurement::Cell Single Rainbow Measurement::SRM Operation Translator.gvi
  Rainbow Measurement Setup::Side Functions::Instrument Control::Arduino::XZ Stage Arduino::XZ Move Requisites.gvi
  NI::G Core::Error::Multiplex Errors.gvi
  NI::G Core::Error::Display Error.gvi
diagram:
  case (TRUE) {
    frame False, Default {
      w1 = no error
    }
    frame True {
      Property Node(instance in="Enum Control Reference Cluster.gtype" {all zero or empty}, "Main Tab"=reference to "Main Tab", "Rainbow Measurement tab"=reference to "Rainbow Measurement tab", "Configuration tab"=reference to "Configuration Tab", "Light Calibration tab"=reference to "Light Calibration Tab", "SRM Plot Parameter Selector"=reference to "SRM Plot Parameter Selector") -> (instance out=w2)
      w3 = "Boolean Control Reference Cluster.gtype" {all zero or empty}
      Property Node(instance in=w3, "Custem date"=reference to "Custom date", "Label Info Missing Error"=reference to "Label Info Missing Error") -> (instance out=w4)
      w5 = "Numeric Control Reference Cluster.gtype" {all zero or empty}
      Property Node(instance in=w5, "Beam Power Density"=reference to "Beam Power Density", "Irradiance Calibration"=reference to "Irradiance Calibration") -> (instance out=w6)
      w7 = "Numeric Cluster Reference Cluster.gtype" {all zero or empty}
      Property Node(instance in=w7, "LPC Parameters"=reference to "LPC Parameters", "Sweep Live Parameters LPC"=reference to "Sweep Live Parameters LPC") -> (instance out=w8)
      w9 = reference to "Path Where the Calibration Files Will Be Stored (Can't Be Changed)"
      Property Node(instance in="Path Reference Cluster.gtype" {all zero or empty}, "Calibration Files Path"=w9, "Default Data Saving Location"=reference to "Default Data Saving Location") -> (instance out=w10)
      Property Node(instance in="Cluster Reference Cluster.gtype" {all zero or empty}, "Light Power Calibration"=reference to "Light Power Calibration", "Light Power Calibration Data"=reference to "Light Power Calibration Data", "Rainbow Sweep Parameters RSM"=reference to "Rainbow Sweep Parameters RSM", "Rainbow Sweep Param Selector MSpot"=reference to "Rainbow Sweep Param Selector MSpot", "MSpot Spectrum Calibration Parameters"=reference to "MSpot Sperctrum Calibration Parameters", "SRM Raw Plot Rainbow Sweep Selector"=reference to "SRM Raw Plot Rainbow Sweep Selector", "SRM Refined Plot Rainbow Sweep Types"=reference to "SRM Refined Plot Rainbow Sweep Types", "SRM Specific Parameters"=reference to "SRM Specific Parameters", "Sweep Live Parameters RSM"=reference to "Sweep Live Parameters RSM", "XZ All Position Cluster"=reference to "XZ All Position Cluster", "Label Info Error Label"=reference to "Label Info Error Label", "Sample Comments"=reference to "Sample Comments", "Cell Number"=reference to "Cell Number", "Author Initials"=reference to "Author Initials", "Batch Name"=reference to "Batch Name", "IV Plot Out "=reference to "IV Plot Out") -> (instance out=w11)
      w12 = "XZ Stage Controls Reference Cluster.gtype" {all zero or empty}
      Property Node(instance in=w12, "Cell Label"=reference to "XZ Stage Cell", "Z Position"=reference to "Z position", "X Position"=reference to "X position", "Activate XZ Stage"=reference to "Activate XZ Stage", "Custom Position"=reference to "Custom Position", "Set Position"=reference to "Set Postion", "XZ Stage Active"=reference to "XZ Stage Active", "Release XZ Stage"=reference to "Release XZ Stage") -> (instance out=w13)
      Property Node(instance in="Full Reference Cluster.gtype" {all zero or empty}, "Enum Reference Cluster"=w2, "Boolean Reference Cluster"=w4, "Numeric Reference Cluster"=w6, "Numeric Cluster Reference Cluster"=w8, "Path Reference Cluster"=w10, "Cluster Reference Cluster"=w11, "XZ Stage Controls Reference Cluster"=w13) -> (instance out=w14)
      $"Full Reference Cluster" <- w14
      w1 = default
    }
  }
  call "FGV Global Abort.gvi"(Global Abort Instructions="Reset State", Error In=w1) -> (Error Out=w15)
  call "FGV Current State.gvi"(Current State Instructions="Set Current State and Substate", Current State="Undefined State", Current Substate="Starting Up", Error In=w15) -> (Error Out=w16)
  Obtain Queue(create if not found=TRUE, element data type="Queue Instructions Control.gtype" "Undefined State", error in=w16, name="Instruction Queue") -> (error out=w17, queue out=w18)
  Enqueue Element(element="Debug Check", error in=w17, queue=w18) -> (error out=w19, queue out=w20)
  s1 = w20  # shift register
  s2 = w19  # shift register
  while {
    # This is the consumer loop, it takes enqueued instructions and performs the ne required actions
    case (s2) {
      frame Error, Default {
        w21 = s2
        w22 = s1
        w23 = TRUE
      }
      frame No Error {
        Dequeue Element(error in=s2, queue=s1) -> (element=w24, error out=w25, queue out=w26)
        case (w24) {
          frame "Undefined State" {
            w21 = w25
            w22 = w26
            w23 = default
          }
          frame "Debug Check" {
            call "Debugging Prompt.gvi"(Debugging Cluster In=$"Debugging Cluster", Error In=w25) -> (Debugging Cluster Out=w27, Error Out=w28)
            Enqueue Element(element="Initialize App", error in=w28, queue=w26) -> (error out=w21, queue out=w22)
            $"Debugging Cluster" <- w27
            w23 = default
          }
          frame "Initialize App" {
            call "Initialize App Bundle In.gvi"(Initialize App Bundle Cluster In=$"Initialize App Bundle Cluster", Debugging Cluster=$"Debugging Cluster", Full Reference Cluster=$"Full Reference Cluster", Error In=w25) -> (Initialize App Bundle Cluster Out=w29, Error Out=w30)
            call "Initialize app subroutine.gvi"(Initialize App Bundle Cluster In=w29, Error In=w30) -> (Initialize App Bundle Cluster Out=w31, Error Out=w32)
            call "Initialize App Bundle Out.gvi"(Initialize App Bundle Cluster In=w31, Error In=w32) -> (Initialize App Bundle Cluster Out=w33, Instrument Coms Info=w34, Debugging Cluster=w35, Error Out=w36)
            $"Initialize App Bundle Cluster" <- w33
            $"Instrument Coms Info" <- w34
            Enqueue Element(element="Idle", error in=w36, queue=w26) -> (error out=w21, queue out=w22)
            $"Debugging Cluster" <- w35
            w23 = default
          }
          frame "Idle", Default {
            call "FGV Global Abort.gvi"(Global Abort Instructions="Reset State", Error In=w25) -> (Error Out=w37)
            call "FGV Current State.gvi"(Current State Instructions="Set Current State and Substate", Current State="Idle", Current Substate="Idle", Error In=w37) -> (Error Out=w38)
            call "Progress FGV.gvi"(FGV Instructions="Reset State", Error In=w38) -> (Error Out=w21)
            w22 = w26
            w23 = default
          }
          frame "MSpot Spectrum Calibration" {
            call "MSpot Folder Check.gvi"(Error In=w25) -> (Calibration Files Folder=w39, Error Out=w40)
            $"Path Where the Calibration Files Will Be Stored (Can't Be Changed)" <- w39
            call "MSpot Spectrum Calibration Subroutine.gvi"(Full Beam Multispectral Data Array In=$"Full Beam Multispectral Data Array", XZ All Position Cluster=$"XZ All Position Cluster", Instrument Coms Info In=$"Instrument Coms Info", Rainbow Sweep Param Selector=$"Rainbow Sweep Param Selector MSpot", MSpot Spectrum Calibration Parameters In=$"MSpot Sperctrum Calibration Parameters", Debugging Cluster In=$"Debugging Cluster", Error In=w40, Stand Alone?=FALSE, Calibration Operation Control=$"Desired MSpot Calibration Operation") -> (Instrument Coms Info Out=w41, Full Beam Multispectral Data Array Out=w42, Debugging Cluster Out=w43, Error Out=w44)
            Enqueue Element(element="Idle", error in=w44, queue=w26) -> (error out=w21, queue out=w22)
            $"Instrument Coms Info" <- w41
            $"Debugging Cluster" <- w43
            $"Full Beam Multispectral Data Array" <- w42
            w23 = default
          }
          frame "Light Power Calibration" {
            call "Light Power Calibration Subroutine.gvi"(Instrument Coms Info In=$"Instrument Coms Info", Debugging Cluster In=$"Debugging Cluster", Rainbow Sweep Param Selector=$"Rainbow Sweep Parameters LPC", Light Power Calibration Data In=$"Light Power Calibration Data", Cell Naming Cluster=$"Cell Naming Cluster", XZ All Position Cluster=$"XZ All Position Cluster", Error In=w25, Default Data Saving Location=$"Default Data Saving Location", Stand Alone?=FALSE) -> (Instuments Coms Info Out=w45, Debugging Cluster Out=w46, Light Power Calibration Data Out=w47, Error Out=w48)
            $"Instrument Coms Info" <- w45
            Enqueue Element(element="Idle", error in=w48, queue=w26) -> (error out=w21, queue out=w22)
            $"Debugging Cluster" <- w46
            $"Light Power Calibration Data" <- w47
            w23 = default
          }
          frame "Move XZ Stage" {
            w21 = w25
            w22 = w26
            w23 = default
          }
          frame "Rainbow Single Measurement" {
            call "Single Rainbow Measurement Subroutine.gvi"(XZ All Position Cluster=$"XZ All Position Cluster", Instrument Coms Info In=$"Instrument Coms Info", Debugging Cluster In=$"Debugging Cluster", Light Power Calibration Data=$"Light Power Calibration Data", Instruction Queue In=w26, Default Data Saving Location=$"Default Data Saving Location", Cell Naming Cluster=$"Cell Naming Cluster", Rainbow Sweep Param Selector=$"Rainbow Sweep Parameters RSM", SRM Specific Parameters=$"SRM Specific Parameters", Error In=w25, Stand Alone?=FALSE, Rainbow Tab Reference=reference to "Rainbow Measurement tab") -> (Instuments Coms Info Out=w49, Debugging Cluster Out=w50, Instruction Queue Out=w51, FulL IV data Cluster=w52, SRM Rainbow Parameters=w53, Error Out=w54)
            Enqueue Element(element="Idle", error in=w54, queue=w51) -> (error out=w21, queue out=w22)
            $"Debugging Cluster" <- w50
            $"Instrument Coms Info" <- w49
            $"FulL IV data Cluster" <- w52
            $"Rainbow Sweep Parameters LPC" <- w53
            w23 = default
          }
          frame "Stop App" {
            call "FGV Current State.gvi"(Current State Instructions="Set Current State and Substate", Current State="Stop App", Current Substate="Bye Bye :D", Error In=w25) -> (Error Out=w21)
            w22 = w26
            w23 = TRUE
          }
        }
      }
    }
    call "Is Error.gvi"(error in=w21) -> (error?=w55)
    Logical Or(w55, w23) -> w56
    call "FGV Global Abort.gvi"(Global Abort Instructions="Set State", Global Abort=w56, Error In=w21) -> (Error Out=w57)
    next s1 = w22
    next s2 = w57
    stop if w56
  }
  s3 = w20  # shift register
  s4 = w19  # shift register
  while {
    event (timeout = 100) {
      on "Timeout" {
        call "FGV Global Abort.gvi"(Global Abort Instructions="Read Current State", Error In=s4) -> (Global Abort Out=w61, Error Out=w62)
        Preview Queue Element(error in=w62, queue=s3, timeout in ms=100) -> (element=w63, error out=w58, queue out=w59)
        Is Equal(x=w63, y="Stop App") -> w64
        Logical Or(w64, w61) -> w60
      }
      on "Abort Button" Value changed {
        call "Global Abort Sequence.gvi"(Queue In=s3, Global Abort=$"Abort Button", Error In=s4) -> (Queue Out=w59, Error Out=w58)
        w60 = default
      }
    }
    next s3 = w59
    next s4 = w58
    stop if w60
  }
  Enqueue Element(element="Stop App", error in=s4, queue=s3) -> (error out=w65)
  # This is the main window it takes instructions from the main pannel introduced by the user and
  # performs the corresponding necessary actions
  s5 = w20  # shift register
  s6 = w19  # shift register
  while {
    # This is the producer loop that takes the commands and if possible enqueues them so that the
    # slave loop can perform the corresponding actions
    event (timeout = 100) {
      on "Timeout" {
        call "SRM Sweep Live Reference Clustering.gvi"(Full Reference Cluster=$"Full Reference Cluster") -> (SRM sweep live parameters FGV Cluster Out=w69)
        call "SRM Sweep Live Parameters FGV.gvi"(FGV Instructions="Read State", SRM sweep live parameters FGV Cluster In=w69, Error In=s6) -> (SRM Live Parameters=w70, IV Plot Out=w71, Error Out=w72)
        call "SRM Sweep Refined Data FGV.gvi"(Full Reference Cluster=$"Full Reference Cluster", Error In=w72, FGV Instructions="Read State") -> (IV Extracted Parameters Plot=w73, Error Out=w74)
        call "Light Calibration Live Parameters FGV.gvi"(Full Reference Cluster=$"Full Reference Cluster", FGV Instructions="Read State", Error In=w74) -> (Light Calibration Parameters Out=w75, Light Power Calibration Graph Out=w76, Error Out=w77)
        call "Progress FGV.gvi"(FGV Instructions="Read State", Error In=w77) -> (Progress Out=w78, Error Out=w79)
        $"Progress %" <- w78
        $"Progress counter" <- w78
        call "Timeout Sequence.gvi"(Queue In=s5, Error In=w79) -> (Stop App?=w68, Queue Out=w66, Current State Out=w80, Current SubState Out=w81, Error Out=w82)
        $"Current State" <- w80
        $Substate <- w81
        $"Current Sub State" <- w81
        $"Sweep Live Parameters RSM" <- w70
        Format Into String(errIn=w82, w80) -> (outString=w83, errOut=w67)
        $State <- w83
        $"IV Plot Out" <- w71
        $"IV Extracted Parameter Plot" <- w73
        $"Sweep Live Parameters LPC" <- w75
        $"Light Power Calibration" <- w76
      }
      on "Exit App Button" Value changed {
        call "Exit App Sequence.gvi"(Queue In=s5, Exit App=$"Exit App Button", Error In=s6) -> (Queue Out=w66, Error Out=w67)
        w68 = default
      }
      on "Check Dividing Wavelength Calibration" Value changed; "Load Dividing Wavelength Calibration" Value changed; "New Dividing Wavelength Calibration" Value changed {
        call "Check Queue And Label.gvi"(Error In=s6) -> (Proceed to enqueue=w84, Error Out=w85)
        call "Conditional Enqueue.gvi"(Queue In=s5, Queue Instruction In="MSpot Spectrum Calibration", Error Out=w85, Equeue?=w84) -> (Queue Out=w66, Error In=w86)
        call "MSpot Calibration Operation Translator.gvi"(Check Dividing Wavelength Calibration=$"Check Dividing Wavelength Calibration", New Dividing Wavelength Calibration=$"New Dividing Wavelength Calibration", Load Dividing Wavelength Calibration=$"Load Dividing Wavelength Calibration", Error In=w86) -> (Desired Operation=w87, Error Out=w67)
        $"Desired MSpot Calibration Operation" <- w87
        w68 = default
      }
      on "Author Initials" Value changed; "Batch Name" Value changed; "Cell Number" Value changed; "Current Date" Value changed; "Custom date" Value changed; "Main Tab" Value changed; "Rainbow Measurement tab" Value changed; "Sample Comments" Value changed; "Sample Prefix" Value changed {
        Property Node(instance in="Sample Naming Cluster.gtype" {all zero or empty}, "Author Initials"=$"Author Initials", "Batch Name"=$"Batch Name", "Sample Comments"=$"Sample Comments", "Main Tab control"=$"Main Tab", "Rainbow Measurement tab"=$"Rainbow Measurement tab", "Cell Number"=$"Cell Number", "Cell Number ref"=reference to "Cell Number", "Custom date"=$"Custom date", "Current Date"=$"Current Date", "Current Date ref"=reference to "Current Date") -> (instance out=w88)
        call "Sample Name Checkup Subroutine.gvi"(Sample Naming Cluster=w88, Error In=s6) -> (Current Date=w89, Sample Prefix=w90, Label Info Error Label=w91, Label Info Missing Error=w92, Error Out=w93, Cell Naming Cluster=w94)
        $"Cell Naming Cluster" <- w94
        $"Sample Prefix" <- w90
        $"Label Info Error Label" <- w91
        call "Sample Prefix FGV.gvi"(FGV Instructions="Set State", Sample Prefix In=w90, Error In=w93) -> (Error Out=w67)
        $"Label Info Missing Error" <- w92
        $"Current Date" <- w89
        w66 = s5
        w68 = default
      }
      on "Load Light Power Calibration" Value changed; "New Light Power Calibration" Value changed; "Save Light Power Calibration" Value changed {
        call "Check Queue And Label.gvi"(Label Info Missing Error=$"Label Info Missing Error", Label Info Error Label=$"Label Info Error Label", Error In=s6, Is Label Necessary?=TRUE) -> (Proceed to enqueue=w95, Error Out=w96)
        call "Conditional Enqueue.gvi"(Queue In=s5, Queue Instruction In="Light Power Calibration", Error Out=w96, Equeue?=w95) -> (Queue Out=w66, Error In=w97)
        call "Light Power Calibration Operation Translator.gvi"(New Light Power Calibration=$"New Light Power Calibration", Load Light Power Calibration=$"Load Light Power Calibration", Save Light Power Calibration=$"Save Light Power Calibration", Error In=w97) -> (Error Out=w67)
        w68 = default
      }
      on "Acquire Single Rainbow Button" Value changed; "Load Single Measurement" Value changed; "Save Single Measurement" Value changed {
        call "Check Queue And Label.gvi"(Label Info Missing Error=$"Label Info Missing Error", Label Info Error Label=$"Label Info Error Label", Error In=s6, Is Label Necessary?=TRUE) -> (Proceed to enqueue=w98, Error Out=w99)
        call "Conditional Enqueue.gvi"(Queue In=s5, Queue Instruction In="Rainbow Single Measurement", Error Out=w99, Equeue?=w98) -> (Queue Out=w66, Error In=w100)
        call "SRM Operation Translator.gvi"(Acquire Single Rainbow Button=$"Acquire Single Rainbow Button", Load Single Measurement=$"Load Single Measurement", Save Single Measurement=$"Save Single Measurement", Error In=w100) -> (Error Out=w67)
        w68 = default
      }
      on "Activate XZ Stage" Value changed {
        call "XZ Move Requisites.gvi"(Queue In=s5, Activate XZ Stage=$"Activate XZ Stage", Instrument Coms Info=$"Instrument Coms Info", Error In=s6) -> (Queue Out=w66, Error Out=w67)
        w68 = default
      }
    }
    Logical Or(w67, w68) -> w101
    next s5 = w66
    next s6 = w67
    stop if w101
  }
  Enqueue Element(element="Stop App", error in=s6, queue=s5) -> (error out=w102)
  call "Multiplex Errors.gvi"(error in 1=w102, error in 2=s2, error in 3=w65) -> (error out=w103)
  Flush Queue(error in=w103, queue=s1) -> (error out=w104, queue out=w105)
  Release Queue(error in=w104, queue=w105) -> (error out=w106)
  case (w106) {
    frame Error, Default {
      # In case there is an error
      # put out an error handler
      call "Display Error.gvi"(error in=w106)
    }
    frame No Error { }
  }
