vi "Instrument Detector.gvi"   [LabVIEW NXG 3.1.0]
inputs:
  "Error In": error
  "Instruments To Detect control": "Instruments To Detect control.gtype" = "Photodetector", required
  "Instrument Address Output Cluster In": "Instrument Address Output Cluster.gtype"
outputs:
  "Error Out": error
  "Instrument Address Output Cluster Out": "Instrument Address Output Cluster.gtype"
types:
  "Instruments To Detect control.gtype" = enum{"Photodetector", "Keithley", "Arduinos", "Thorlabs Motors"}
  T1 = cluster{"Element 1": "VISA Instr", "Element 2": string}
  "Arduino Detection cluster control.gtype" = cluster{"XZ Stage Arduino Address": "VISA Instr", "XZ Stage Arduino Detected?": bool, "Multiplexer Arduino Detected?": bool, "Multiplexer Arduino Address": "VISA Instr", "Arduinos List": T1[]}
  "Thorlabs Motors Serial Number In.gtype" = cluster{"Thorlabs Blue Motor": string, "Thorlabs Red Motor": string}
  "Instrument Address Output Cluster.gtype" = cluster{"Arduino Coms Info": "Arduino Detection cluster control.gtype", "Photodetector Names": string[], "Keythley Address": "VISA Instr", "Photodetector Detected?": bool, "Thorlabs Motors Detected?": bool, "Keithley Detected?": bool, "Thorlabs Motors Serial Number In": "Thorlabs Motors Serial Number In.gtype"}
uses:
  Rainbow Measurement Setup::Main Functions::Instruction Queue::Current State::FGV Current State.gvi
  Rainbow Measurement Setup::Side Functions::Instrument Control::Photodetector Detection Subroutine.gvi
  Rainbow Measurement Setup::Side Functions::Instrument Control::Keithley Detection Subroutine.gvi
  Rainbow Measurement Setup::Side Functions::Instrument Control::Arduino::Arduino Detection Subroutine.gvi
  Rainbow Measurement Setup::Side Functions::Instrument Control::Thorlabs Motors::Thorlabs motor Detector.gvi
diagram:
  case ($"Error In") {
    frame Error, Default {
      w1 = $"Error In"
    }
    frame No Error {
      case ($"Instruments To Detect control") {
        frame "Photodetector", Default {
          call "FGV Current State.gvi"(Current State Instructions="Set current Substate", Current Substate="Detecting Photodetector", Error In=$"Error In") -> (Error Out=w3)
          call "Photodetector Detection Subroutine.gvi"(Error In=w3) -> (Photodetector Names=w4, Detected?=w5, Error Out=w1)
          Property Node(instance in=$"Instrument Address Output Cluster In", "Photodetector Names"=w4, "Photodetector Detected?"=w5) -> (instance out=w2)
        }
        frame "Keithley" {
          call "FGV Current State.gvi"(Current State Instructions="Set current Substate", Current Substate="Detecting Keithley", Error In=$"Error In") -> (Error Out=w6)
          call "Keithley Detection Subroutine.gvi"(Error In=w6) -> (Keythley Address Out=w7, Detected?=w8, Error Out=w1)
          Property Node(instance in=$"Instrument Address Output Cluster In", "Keythley Address"=w7, "Keithley Detected?"=w8) -> (instance out=w2)
        }
        frame "Arduinos" {
          call "FGV Current State.gvi"(Current State Instructions="Set current Substate", Current Substate="Detecting Arduinos", Error In=$"Error In") -> (Error Out=w9)
          call "Arduino Detection Subroutine.gvi"(Error In=w9) -> (Arduino Detection Cluster Info Out=w10, Error Out=w1)
          Property Node(instance in=$"Instrument Address Output Cluster In", "Arduino Coms Info"=w10) -> (instance out=w2)
        }
        frame "Thorlabs Motors" {
          Property Node(instance in=$"Instrument Address Output Cluster In") -> ("Thorlabs Motors Serial Number In"=w11, instance out=w12)
          call "FGV Current State.gvi"(Current State Instructions="Set current Substate", Current Substate="Detecting Thorlabs Motors", Error In=$"Error In") -> (Error Out=w13)
          call "Thorlabs motor Detector.gvi"(Thorlabs Motors Serial Number In=w11, Error In=w13) -> (Detected?=w14, Thorlabs Motors Serial Number Out=w15, Error Out=w1)
          Property Node(instance in=w12, "Thorlabs Motors Detected?"=w14, "Thorlabs Motors Serial Number In"=w15) -> (instance out=w2)
        }
      }
      $"Instrument Address Output Cluster Out" <- w2
    }
  }
  $"Error Out" <- w1
