vi "Keithley Set Constant Parameters.gvi"   [LabVIEW NXG 5.0.0]
inputs:
  "Error In": error
  "Instrument Coms Info In": "Instrument Coms Info.gtype"
  "Debugging Cluster In": "Debugging Cluster.gtype"
  "SRM Specific Parameters In": "SRM Specific Parameters.gtype"
outputs:
  "Error Out": error
  "Instrument Coms Info Out": "Instrument Coms Info.gtype"
  "Debugging Cluster Out": "Debugging Cluster.gtype"
  "SRM Specific Parameters Out": "SRM Specific Parameters.gtype"
types:
  T1 = cluster{"Element 1": "VISA Instr", "Element 2": string}
  "Arduino Detection cluster control.gtype" = cluster{"XZ Stage Arduino Address": "VISA Instr", "XZ Stage Arduino Detected?": bool, "Multiplexer Arduino Detected?": bool, "Multiplexer Arduino Address": "VISA Instr", "Arduinos List": T1[], "XZ Stage Log": string, "Multiplexer Log": string}
  "Thorlabs Motors Serial Number In.gtype" = cluster{"Thorlabs Blue Motor": string, "Thorlabs Red Motor": string, "Blue Motor Homed?": bool, "Red Motor Homed?": bool}
  "Instrument Coms Info.gtype" = cluster{"Arduino Coms Info": "Arduino Detection cluster control.gtype", "Photodetector Names": string[], "Keythley Address": "VISA Instr", "Photodetector Detected?": bool, "Thorlabs Motors Detected?": bool, "Keithley Detected?": bool, "Thorlabs Motors Serial Number": "Thorlabs Motors Serial Number In.gtype", "Photodetector IVI session": "Ivi IviDefault", "Flame ID": string, "Flame Detected?": bool, "Flame Wrapper ID": u64}
  "Insturment Debugging Cluster.gtype" = cluster{"Keithley": bool, "Arduinos": bool, "Thorlabs Motors": bool, "Photodetector": bool, "Flame Spectr": bool}
  "Debugging Cluster.gtype" = cluster{"Debugging mode?": bool, "Initialize App": bool, "Insturment Debugging": "Insturment Debugging Cluster.gtype"}
  "SRM Specific Parameters.gtype" = cluster{"Max Voltage (V)": f64, "Min Voltage (V)": f64, "Voltage Points": u32, "Current Range (A)": f64, "Autorange": bool, "Sweep Direction": bool, "Current Averages": u32, "Max Current (A)": f64, "Integration Time": f64, "Cell Area (m^2)": f64}
uses:
  Rainbow Measurement Setup::Main Functions::Instruction Queue::Current State::FGV Current State.gvi
  Rainbow Measurement Setup::Side Functions::Instrument Control::Keithley::Keithley Sweep Parameters Calculator.gvi
  Labview_NXG_Keithley_SMU_2450_2460_2461::Configure::Configure Measurement Range.gvi
  Labview_NXG_Keithley_SMU_2450_2460_2461::Configure::Configure Output.gvi
  Labview_NXG_Keithley_SMU_2450_2460_2461::Configure::Configure Source Function.gvi
  Labview_NXG_Keithley_SMU_2450_2460_2461::Configure::Configure Measurement Function.gvi
  Labview_NXG_Keithley_SMU_2450_2460_2461::Configure::Configure Integration Filter.gvi
  Labview_NXG_Keithley_SMU_2450_2460_2461::Configure::Configure Linear Mode Sweep.gvi
diagram:
  # This SubVI Sets all the desired parameter for the keitley sweep
  case ($"Error In") {
    frame Error, Default {
      w1 = $"Error In"
      w2 = $"Instrument Coms Info In"
      w3 = $"Debugging Cluster In"
      w4 = $"SRM Specific Parameters In"
    }
    frame No Error {
      Property Node(instance in=$"Debugging Cluster In") -> ("Debugging mode?"=w5, "Insturment Debugging:Keithley"=w6, instance out=w3)
      Logical And[output inverted](w5, not w6) -> w7
      case (w7) {
        frame False, Default {
          w2 = $"Instrument Coms Info In"
          w1 = $"Error In"
          w4 = $"SRM Specific Parameters In"
        }
        frame True {
          Property Node(instance in=$"Instrument Coms Info In") -> ("Keythley Address"=w8, instance out=w9)
          call "FGV Current State.gvi"(Current State Instructions="Set Current Substate", Current Substate="Setting Keithley Parameters", Error In=$"Error In") -> (Error Out=w10)
          call "Keithley Sweep Parameters Calculator.gvi"(SRM Parameters in=$"SRM Specific Parameters In", Error In=w10) -> (Measurement Speed (1 PLC)=w11, SRM Parameters Out=w4, Manual Range (1.0)=w12, Sweep Points=w13, Error Out=w14, Enable Auto Range (T:Enable)=w15)
          call "Configure Measurement Range.gvi"(VISA resource name=w8, Function (0: Volts)="Volts"(0), Enable Auto Range (T:Enable)=TRUE, error in (no error)=w14) -> (VISA resource name out=w16, error out=w17)
          call "Configure Measurement Range.gvi"(Manual Range (1.0)=w12, VISA resource name=w16, Function (0: Volts)="Current"(1), Enable Auto Range (T:Enable)=w15, error in (no error)=w17) -> (VISA resource name out=w18, error out=w19)
          call "Configure Output.gvi"(VISA resource name=w18, Source Mode (0: Voltage)="Voltage"(0), error in (no error)=w19) -> (VISA resource name out=w20, error out=w21)
          call "Configure Source Function.gvi"(VISA resource name=w20, Function (0: Volts)="Volts"(0), error in (no error)=w21) -> (VISA resource name out=w22, error out=w23)
          call "Configure Measurement Function.gvi"(VISA resource name=w22, Function (0: Volts)="Current"(1), error in (no error)=w23) -> (VISA resource name out=w24, error out=w25)
          call "Configure Integration Filter.gvi"(VISA resource name=w24, Function (0: Volts)="Volts"(0), Measurement Speed (1 PLC)=w11, error in (no error)=w25) -> (VISA resource name out=w26, error out=w27)
          call "Configure Linear Mode Sweep.gvi"(VISA resource name=w26, Source Mode (0: Voltage)="Voltage"(0), Sweep Points=w13, Delay (0)=0, error in (no error)=w27) -> (VISA resource name out=w28, error out=w1)
          Property Node(instance in=w9, "Keythley Address"=w28) -> (instance out=w2)
        }
      }
    }
  }
  $"Debugging Cluster Out" <- w3
  $"SRM Specific Parameters Out" <- w4
  $"Instrument Coms Info Out" <- w2
  $"Error Out" <- w1
