vi "KCube Dividing Wavelength Translator.gvi"   [LabVIEW NXG 5.0.0]
inputs:
  "Error In": error
outputs:
  "Error Out": error
panel controls:
  "Rainbow Sweep Types": "Rainbow Sweep Types.gtype" = "Red Sweep Closing"
  "Dividing Wavelength": f64
panel indicators:
  "KCube Coordinates": "KCube Coordinates.gtype"
types:
  "Rainbow Sweep Types.gtype" = enum{"Red Sweep Closing", "Red Sweep Opening", "Blue Sweep Closing", "Blue Sweep Opening"}
  "KCube Coordinates.gtype" = cluster{"Blue Motor Position to move to (mm)": f64, "Red Motor Position to move to (mm)": f64}
uses:
  Rainbow Measurement Setup::Side Functions::Utilities::Round Number.gvi
diagram:
  case ($"Error In") {
    frame Error, Default {
      w1 = $"Error In"
      w2 = _
    }
    frame No Error {
      case ($"Rainbow Sweep Types") {
        frame "Red Sweep Closing", Default {
          Property Node(instance in="KCube Coordinates.gtype" {all zero or empty}) -> (instance out=w2)
        }
        frame "Red Sweep Opening" {
          Property Node(instance in="KCube Coordinates.gtype" {all zero or empty}) -> (instance out=w2)
        }
        frame "Blue Sweep Closing" {
          Property Node(instance in="KCube Coordinates.gtype" {all zero or empty}) -> (instance out=w2)
        }
        frame "Blue Sweep Opening" {
          Property Node(instance in="KCube Coordinates.gtype" {all zero or empty}) -> (instance out=w2)
        }
      }
      call "Round Number.gvi"(Number To Round=$"Dividing Wavelength", Number Of Decimals=1)
      w1 = _
    }
  }
  $"Error Out" <- w1
  $"KCube Coordinates" <- w2
