vi "Path Check & Generation.gvi"   [LabVIEW NXG 5.0.0]
inputs:
  "Error In": error
  "Default Data Saving Location": path
  "Measurement File Type": "Measurement File Type.gtype" = "Single Cell Rainbow"
  "Cell Naming Cluster": "Cell Naming Cluster.gtype"
outputs:
  "Error Out": error
  "File path": path
  "Folder to save data": path
types:
  "Measurement File Type.gtype" = enum{"Single Cell Rainbow", "Multiple Cell Rainbow", "Light Calibration Irradiance", "Light Calibration Spectral Density", "Light Calibration Power Density"}
  "Cell Naming Cluster.gtype" = cluster{"Cell Label": string, "Sample Prefix": string, "Author Initials": string, "Current Date": string, "Batch Name": string}
uses:
  NI::G Core::File IO (General)::Check if File or Folder Exists.gvi
  Rainbow Measurement Setup::Side Functions::Messages And Prompts::Select path prompt.gvi
  Rainbow Measurement Setup::Side Functions::Path Manipulation::Create or Open Folder.gvi
  Rainbow Measurement Setup::Side Functions::Utilities::Cell Naming::txt Extension adder.gvi
diagram:
  case ($"Error In") {
    frame Error, Default {
      w1 = $"Error In"
    }
    frame No Error {
      case ($"Error In") {
        frame Error, Default {
          w1 = $"Error In"
        }
        frame No Error {
          Property Node(instance in=$"Cell Naming Cluster") -> ("Author Initials"=w2, "Current Date"=w3, "Batch Name"=w4, "Cell Label"=w5, "Sample Prefix"=w6)
          Concatenate Strings("Device ", w4) -> w7
          call "Check if File or Folder Exists.gvi"(file or folder=$"Default Data Saving Location", error in=$"Error In") -> (file or folder exists?=w8, error out=w9)
          Is Empty String Or Path(string/path=$"Default Data Saving Location") -> w10
          Logical Or(w10, not w8) -> w11
          case (w11) {
            frame False {
              w12 = $"Default Data Saving Location"
              w13 = w9
            }
            frame True {
              w14 = "Please specify the path where you want to save all your measurements:"
              call "Select path prompt.gvi"(Main Message=w14, Sub message="Sub paths with your name, date and device will be created", Error In=w9) -> (New Path=w12, Error Out=w13)
            }
          }
          call "Create or Open Folder.gvi"(Folder Root Path=w12, Folder Name=w2, Error In=w13) -> (New Folder's Path=w15, Error Out=w16)
          call "Create or Open Folder.gvi"(Folder Root Path=w15, Folder Name=w3, Error In=w16) -> (New Folder's Path=w17, Error Out=w18)
          call "Create or Open Folder.gvi"(Folder Root Path=w17, Folder Name=w7, Error In=w18) -> (New Folder's Path=w19, Error Out=w20)
          call "Create or Open Folder.gvi"(Folder Root Path=w19, Folder Name="TXT files", Error In=w20) -> (New Folder's Path=w21, Error Out=w22)
          case ($"Measurement File Type") {
            frame "Single Cell Rainbow" {
              w23 = ""
            }
            frame "Multiple Cell Rainbow" {
              w23 = w5
            }
            frame "Light Calibration Irradiance" {
              w23 = "Irradiance_Calibration"
            }
            frame "Light Calibration Spectral Density" {
              w23 = "Spectral_Density_Calibration"
            }
            frame "Light Calibration Power Density" {
              w23 = "Power_Density_Calibration"
            }
          }
          Concatenate Strings(w6, w23) -> w24
          call "txt Extension adder.gvi"(Name without .txt=w24, Error In=w22) -> (Name with .txt=w25, Error Out=w1)
          Build Path(base path=w21, name or relative path=w25) -> (appended path=w26)
          $"File path" <- w26
          $"Folder to save data" <- w12
        }
      }
    }
  }
  $"Error Out" <- w1
