vi "Timeout Read FGV Data Subroutine.gvi"   [LabVIEW NXG 5.0.0]
inputs:
  "Misc Data Mega Cluster In": "Misc Data Mega Cluster.gtype"
  "Error In": error
outputs:
  "Misc Data Mega Cluster Out": "Misc Data Mega Cluster.gtype"
  "Error Out": error
types:
  "Full Reference Cluster.gtype" = cluster{"Enum Reference Cluster": "Enum Control Reference Cluster.gtype", "Boolean Reference Cluster": "Boolean Control Reference Cluster.gtype", "Numeric Reference Cluster": "Numeric Control Reference Cluster.gtype", "Numeric Cluster Reference Cluster": "Numeric Cluster Reference Cluster.gtype", "Path Reference Cluster": "Path Reference Cluster.gtype", "Cluster Reference Cluster": "Cluster Reference Cluster.gtype", "XZ Stage Controls Reference Cluster": "XZ Stage Controls Reference Cluster.gtype"}
  "Cell Naming Cluster.gtype" = cluster{"Cell Label": string, "Sample Prefix": string, "Author Initials": string, "Current Date": string, "Batch Name": string}
  T1 = cluster{"X Coordinate (mm)": f64, "Z Coordinate (mm)": f64}
  T2 = cluster{"X Coordinate (mm)": f64, "Z Coordinate (mm)": f64, "Vertical Spacing (mm)": f64}
  "XZ All Position Cluster.gtype" = cluster{"Diffusor Coordinates": T1, "Photodetector Coordinates": T1, "Cell R.01 Coordinates": T2}
  T3 = cluster{"Thorlabs Motor Serial Number File Path": path, "Default Data Saving Location": path}
  "Misc Data Mega Cluster.gtype" = cluster{"Full Reference Cluster": "Full Reference Cluster.gtype", "Cell Naming Cluster": "Cell Naming Cluster.gtype", "All XZ Position Cluster": "XZ All Position Cluster.gtype", "All Paths": T3}
uses:
  Rainbow Measurement Setup::Main Functions::Rainbow Measurement::Cell Single Rainbow Measurement::SRM Live Parameters::SRM Sweep Live Reference Clustering.gvi
  Rainbow Measurement Setup::Main Functions::Rainbow Measurement::Cell Single Rainbow Measurement::SRM Live Parameters::SRM Sweep Live Parameters FGV.gvi
  Rainbow Measurement Setup::Main Functions::Rainbow Measurement::Cell Single Rainbow Measurement::Plotting::SRM Sweep Refined Data FGV.gvi
  Rainbow Measurement Setup::Main Functions::Rainbow Measurement::Light Power Calibration::Light Calibration Live Parameters FGV.gvi
diagram:
  # This SubVI Reads the data stored in the FGVs and outputs it so that
  # the graphs and everything can be populated, but it only does during
  # their respective subroutines so that it does not get overwhelmed
  case ($"Error In") {
    frame Error, Default {
      w1 = $"Error In"
      w2 = $"Misc Data Mega Cluster In"
    }
    frame No Error {
      s1 = uninitialised  # shift register
      s1.prev1 = uninitialised  # shift register
      s1.prev2 = uninitialised  # shift register
      s2 = $"Misc Data Mega Cluster In"  # shift register
      s3 = uninitialised  # shift register
      while {
        Property Node(instance in=s2) -> ("Full Reference Cluster"=w3, "Full Reference Cluster:Enum Reference Cluster:Current State"=w4, instance out=w5)
        Property Node(instance in=w4, error in=$"Error In") -> ("Value"=w6, error out=w7)
        Is Equal(x=s1, y=s1.prev1) -> w8
        Is Equal(x=s1.prev1, y=s1.prev2) -> w9
        Logical And(w8, w9) -> w10
        Select(s=w10, t=w6, f=s1.prev2) -> w11
        case (w11) {
          frame "Rainbow Single Measurement" {
            call "SRM Sweep Live Reference Clustering.gvi"(Full Reference Cluster=w3) -> (SRM sweep live parameters FGV Cluster Out=w14)
            call "SRM Sweep Live Parameters FGV.gvi"(FGV Instructions="Read State", SRM sweep live parameters FGV Cluster In=w14, Error In=w7) -> (SRM Live Parameters=w15, IV Plot Out=w16, Error Out=w17)
            call "SRM Sweep Refined Data FGV.gvi"(Full Reference Cluster=w3, Error In=w17, FGV Instructions="Read State") -> (IV Extracted Parameters Plot=w18, Error Out=w19)
            Property Node(instance in=w5) -> ("Full Reference Cluster:Cluster Reference Cluster:Sweep Live Parameters RSM"=w20, "Full Reference Cluster:Cluster Reference Cluster:IV Plot Out "=w21, "Full Reference Cluster:Cluster Reference Cluster:IV Extracted Parameter Plot "=w22, instance out=w12)
            Property Node(instance in=w20, "Value"=w15, error in=w19) -> (error out=w23)
            Property Node(instance in=w21, "Value"=w16, error in=w23) -> (error out=w24)
            Property Node(instance in=w22, "Value"=w18, error in=w24) -> (error out=w1)
            w13 = s3
          }
          frame "Idle", Default {
            Property Node(instance in=w3) -> ("Enum Reference Cluster:Main Tab"=w25, "Enum Reference Cluster:Rainbow Measurement tab"=w26, "Cluster Reference Cluster:SRM Raw Plot Rainbow Sweep Selector"=w27, instance out=w28)
            Property Node(instance in=w25, error in=w7) -> ("Value"=w29, error out=w30)
            Property Node(instance in=w26, error in=w30) -> ("Value"=w31, error out=w32)
            Property Node(instance in=w27, error in=w32) -> ("Value"=w13, error out=w33)
            Is Not Equal(x=s3, y=w13) -> w34
            Is Equal To 0(x=w29) -> w35
            Is Equal(x=w31, y=2) -> w36
            Logical And(w35, w36) -> w37
            case (w37) {
              frame False, Default {
                w38 = w33
                w39 = w5
              }
              frame True {
                Property Node(instance in=w5) -> ("Full Reference Cluster:Cluster Reference Cluster:IV Extracted Parameter Plot "=w40, instance out=w39)
                call "SRM Sweep Refined Data FGV.gvi"(Full Reference Cluster=w28, Error In=w33, FGV Instructions="Read State") -> (IV Extracted Parameters Plot=w41, Error Out=w42)
                Property Node(instance in=w40, "Value"=w41, error in=w42) -> (error out=w38)
              }
            }
            case (w34) {
              frame False, Default {
                w1 = w38
                w12 = w39
              }
              frame True {
                Property Node(instance in=w39) -> ("Full Reference Cluster:Cluster Reference Cluster:IV Plot Out "=w43, instance out=w12)
                call "SRM Sweep Live Reference Clustering.gvi"(Full Reference Cluster=w3) -> (SRM sweep live parameters FGV Cluster Out=w44)
                call "SRM Sweep Live Parameters FGV.gvi"(FGV Instructions="Read State", SRM sweep live parameters FGV Cluster In=w44, Error In=w38) -> (IV Plot Out=w45, Error Out=w46)
                Property Node(instance in=w43, "Value"=w45, error in=w46) -> (error out=w1)
              }
            }
          }
          frame "Light Power Calibration" {
            Property Node(instance in=w5) -> ("Full Reference Cluster:Cluster Reference Cluster:Light Power Calibration"=w47, "Full Reference Cluster:Numeric Cluster Reference Cluster:Sweep Live Parameters LPC"=w48, instance out=w12)
            call "Light Calibration Live Parameters FGV.gvi"(Full Reference Cluster=w3, FGV Instructions="Read State", Error In=w7) -> (Light Calibration Parameters Out=w49, Light Power Calibration Graph Out=w50, Error Out=w51)
            Property Node(instance in=w47, "Value"=w50, error in=w51) -> (error out=w52)
            Property Node(instance in=w48, "Value"=w49, error in=w52) -> (error out=w1)
            w13 = s3
          }
        }
        next s1 = w6
        next s2 = w12
        next s3 = w13
        stop if TRUE
      }
      w2 = s2
    }
  }
  $"Misc Data Mega Cluster Out" <- w2
  $"Error Out" <- w1
